# Grasshopper definition 20240409_Revit_LCA.gh (Grasshopper 1.0.7)
# plug-ins: Rhino.Inside for Autodesk Revit, Human, LunchBox, MetaHopper

wiredisplay = ControlWireDisplay(WireDisplay=Slider(2, range=0..10), AllObjects_Object=bygningsdele_2)
antal_elementer_der_tælles_med_i_query_e = Panel("10000000")  # "Antal elementer der tælles med i 'Query Elements'-componentet"

# ---- group: Importering af geometri
# Vægge
categories = BuiltInCategories("autodesk.revit.category.local:walls-1.0.0", SearchPattern="walls")
catfltr = CategoryFilter(Categories=categories, Inverted=False)
elements = QueryElements(Filter=catfltr, Limit=antal_elementer_der_tælles_med_i_query_e)  # -> Elements, Count

# Tage
categories_2 = BuiltInCategories("autodesk.revit.category.local:roofs-1.0.0", SearchPattern="Roofs")
catfltr_2 = CategoryFilter(Categories=categories_2, Inverted=False)
elements_2 = QueryElements(Filter=catfltr_2, Limit=antal_elementer_der_tælles_med_i_query_e)  # -> Elements, Count

# Lofte
categories_3 = BuiltInCategories("autodesk.revit.category.local:ceilings-1.0.0", SearchPattern="ceilings")
catfltr_3 = CategoryFilter(Categories=categories_3, Inverted=False)
elements_3 = QueryElements(Filter=catfltr_3, Limit=antal_elementer_der_tælles_med_i_query_e)  # -> Elements, Count

# Gulve
categories_4 = BuiltInCategories("autodesk.revit.category.local:floors-1.0.0", SearchPattern="Floors")
catfltr_4 = CategoryFilter(Categories=categories_4, Inverted=False)
elements_4 = QueryElements(Filter=catfltr_4, Limit=antal_elementer_der_tælles_med_i_query_e)  # -> Elements, Count

# Vinduer
categories_5 = BuiltInCategories("autodesk.revit.category.family:windows-1.0.0", SearchPattern="Windows")
catfltr_5 = CategoryFilter(Categories=categories_5, Inverted=False)
elements_5 = QueryElements(Filter=catfltr_5, Limit=antal_elementer_der_tælles_med_i_query_e)  # -> Elements, Count

# Døre
categories_6 = BuiltInCategories("autodesk.revit.category.family:doors-1.0.0", SearchPattern="doors")
catfltr_6 = CategoryFilter(Categories=categories_6, Inverted=False)
elements_6 = QueryElements(Filter=catfltr_6, Limit=antal_elementer_der_tælles_med_i_query_e)  # -> Elements, Count

# ---- group: Input data - SKAL UDFYLDES
typologi = ValueList({"Rækkehus": 0, "Etagebolig": 1, "Kontor": 2, "Plejebolig": 3, "Daginstitution": 4, "Skole": 5, "Øvrige bygninger": 6}, selected="Plejebolig")
sti_til_excel_fil = Panel("C:\Users\lhf\Desktop\LCA Script\LCAByg - Export - Resultatliste.xlsm")
cluster = Cluster_2(i=typologi, i_2=typologi)  # -> i_3, i_4
gulvareal_m2 = Panel("302")
analyseperiode_år = Panel("50")
usikkerhedsfaktor = Panel("1.1")
drift = Data(cluster.i_3)
typologi_2 = Data(cluster.i_4)
load_unload = BooleanToggle(True)
fill_sti = FilePath(sti_til_excel_fil)

# ---- group: Standardværdier for teknik / Vand
true_false = Boolean(load_unload)
filsti = FilePath(fill_sti)
txt = Text("Vand")
excelread = ExcelReader(ReadExcelData=true_false, WorkbookPath=filsti, WorksheetName=txt)  # -> Exceptions, ExcelData
branch = TreeBranch(Tree=excelread.ExcelData, Path=Slider(1, range=0..1), MaintainPaths=True)
branch_2 = TreeBranch(Tree=excelread.ExcelData, Path=Slider(0, range=0..1), MaintainPaths=True)
typologi_3 = Data(typologi_2)
item = ListItem(List=branch, Index=typologi_3, Wrap=True)
item_2 = ListItem(List=branch_2, Index=typologi_3, Wrap=True)
num = Number(gulvareal_m2)
multiplication = Multiplication(A=num, B=item)

# ---- group: Standardværdier for teknik / Afløb
true_false_2 = Boolean(load_unload)
filsti_2 = FilePath(fill_sti)
txt_2 = Text("Afløb")
excelread_2 = ExcelReader(ReadExcelData=true_false_2, WorkbookPath=filsti_2, WorksheetName=txt_2)  # -> Exceptions, ExcelData
branch_3 = TreeBranch(Tree=excelread_2.ExcelData, Path=Slider(1, range=0..1), MaintainPaths=True)
branch_4 = TreeBranch(Tree=excelread_2.ExcelData, Path=Slider(0, range=0..1), MaintainPaths=True)
typologi_4 = Data(typologi_2)
item_3 = ListItem(List=branch_3, Index=typologi_4, Wrap=True)
item_4 = ListItem(List=branch_4, Index=typologi_4, Wrap=True)
num_2 = Number(gulvareal_m2)
multiplication_2 = Multiplication(A=num_2, B=item_3)

# ---- group: Standardværdier for teknik / Ventilation og køl
true_false_3 = Boolean(load_unload)
filsti_3 = FilePath(fill_sti)
txt_3 = Text("Ventilation og køl")
excelread_3 = ExcelReader(ReadExcelData=true_false_3, WorkbookPath=filsti_3, WorksheetName=txt_3)  # -> Exceptions, ExcelData
branch_5 = TreeBranch(Tree=excelread_3.ExcelData, Path=Slider(1, range=0..1), MaintainPaths=True)
branch_6 = TreeBranch(Tree=excelread_3.ExcelData, Path=Slider(0, range=0..1), MaintainPaths=True)
typologi_5 = Data(typologi_2)
item_5 = ListItem(List=branch_5, Index=typologi_5, Wrap=True)
item_6 = ListItem(List=branch_6, Index=typologi_5, Wrap=True)
num_3 = Number(gulvareal_m2)
multiplication_3 = Multiplication(A=num_3, B=item_5)

# ---- group: Standardværdier for teknik
# Reference: Værdier henter fra:
# 
# Social- og Bolig styrelsen -
# Oplæg til Defaultværdier for Installationer
addition = Addition(Vand=multiplication, Afløb=multiplication_2, VentKøl=multiplication_3)

# ---- group: Visning af bygningsdele
tænd_sluk = BooleanToggle(True)
yder_indervægge = EnableDisableObject(
    Enabled=tænd_sluk,
    AllObjects_Object=[preview_5, preview_6, preview_7, preview_8, preview_9, preview_10, preview_11, preview_12])
tænd_sluk_2 = BooleanToggle(True)
tager_lofter = EnableDisableObject(
    Enabled=tænd_sluk_2,
    AllObjects_Object=[preview_35, preview_36, preview_37, preview_38, preview_39, preview_40, preview_41, preview_42])
tænd_sluk_3 = BooleanToggle(True)
terrændæk = EnableDisableObject(
    Enabled=tænd_sluk_3,
    AllObjects_Object=[preview_21, preview_22, preview_23, preview_24, preview_25, preview_26, preview_27, preview_28])
tænd_sluk_4 = BooleanToggle(True)
fundamenter = EnableDisableObject(Enabled=tænd_sluk_4, AllObjects_Object=[preview, preview_2, preview_3, preview_4])
tænd_sluk_5 = BooleanToggle(True)
dæk = EnableDisableObject(
    Enabled=tænd_sluk_5,
    AllObjects_Object=[preview_13, preview_14, preview_15, preview_16, preview_17, preview_18, preview_19, preview_20])
tænd_sluk_6 = BooleanToggle(True)
vinduer_døre_og_glasfacader = EnableDisableObject(Enabled=tænd_sluk_6, AllObjects_Object=[preview_29, preview_30, preview_31, preview_32, preview_33, preview_34])

# ---- group: Live visning af ændringer i EXCEL 'Resultat ark'
panel = Panel("""Bygningsdel
Areal
GWP Total""")
toggle = BooleanToggle(True)

# ---- group: Resultat / Udregning af resultat
num_4 = Number(addition)
num_5 = Number(gulvareal_m2)
num_6 = Number(analyseperiode_år)
usikkerhedsfaktor_2 = Number(usikkerhedsfaktor)
drift_2 = Data(drift)

# ---- group: Yder- & Indervægge
# Type 1
element_type_picker = ElementTypePicker(
    categories,
    {"Basic Wall : CL_W1": "e340d1fc-19c1-4200-9ff0-415bc126641d:e9d71ae9-50a0-4fd0-b533-dbc08decd09f-00092a3a", "Basic Wall : Cavity wall_sliders": "e340d1fc-19c1-4200-9ff0-415bc126641d:f565bef9-7d27-4781-b8d4-60f4a6034d87-000ce6a8", "Basic Wall : Exterior - Block on Mtl. Stud": "e340d1fc-19c1-4200-9ff0-415bc126641d:4d24d0d6-38f1-47b8-a376-b40c6432dad5-0000d50a", "Basic Wall : Exterior - Brick on Mtl. Stud": "e340d1fc-19c1-4200-9ff0-415bc126641d:e3e052f9-0156-11d5-9301-0000863f27ad-0000018d", "Basic Wall : Foundation - 300mm Concrete": "e340d1fc-19c1-4200-9ff0-415bc126641d:7f28cee1-b998-4a37-89e2-f58405cbbc56-0008df7c", "Basic Wall : Interior - 165 Partition (1-hr)": "e340d1fc-19c1-4200-9ff0-415bc126641d:88b03b05-80d3-484f-8022-471f61604c8d-00038d32", "Basic Wall : Interior - Partition": "e340d1fc-19c1-4200-9ff0-415bc126641d:88b03b05-80d3-484f-8022-471f61604c8d-00038d7b", "Basic Wall : Retaining - 300mm Concrete": "e340d1fc-19c1-4200-9ff0-415bc126641d:1551350c-45e5-41b8-bdf1-bcfa6794dc6a-000adce2", "Basic Wall : SIP 202mm Wall - conc clad": "e340d1fc-19c1-4200-9ff0-415bc126641d:c85e5be0-d8d5-4148-836f-b55e711ef373-00068b9b", "Basic Wall : Wall - Timber Clad": "e340d1fc-19c1-4200-9ff0-415bc126641d:ef57b02a-5e81-49e7-93bb-ae5f002d921c-000306df", "Curtain Wall : SH_Curtain wall": "e340d1fc-19c1-4200-9ff0-415bc126641d:6cbabf1d-e8d0-47f0-ac4d-9a7923128d37-000700af"}, selected=["Basic Wall : Interior - 165 Partition (1-hr)", "Basic Wall : Interior - Partition"])
value_list = ValueList({"Indervæg": False, "Ydervæg": True}, selected="Indervæg")

# ---- group: Fundamenter
value_list_2 = ValueList({"Meter": False, "Antal": True}, selected="Meter")
value_list_3 = ValueList({"Meter": False, "Antal": True}, selected="Meter")  # disabled
value_list_4 = ValueList({"Meter": False, "Antal": True}, selected="Antal")  # disabled
value_list_5 = ValueList({"Meter": False, "Antal": True}, selected="Antal")  # disabled
true_false_4 = Boolean(load_unload)
filsti_4 = FilePath(fill_sti)
fundamenter_2 = Fundamenter(read=true_false_4, path=filsti_4)  # -> gwp, bygningsdel

not = GateNot(A=value_list_2)
onoff = EnableDisableObject(Enabled=value_list_2, AllObjects_Object=antal)
onoff_2 = EnableDisableObject(Enabled=not, AllObjects_Object=meter)

not_2 = GateNot(A=value_list_3)
onoff_3 = EnableDisableObject(Enabled=value_list_3, AllObjects_Object=antal_2)
onoff_4 = EnableDisableObject(Enabled=not_2, AllObjects_Object=meter_2)

not_3 = GateNot(A=value_list_4)
onoff_5 = EnableDisableObject(Enabled=value_list_4, AllObjects_Object=antal_3)
onoff_6 = EnableDisableObject(Enabled=not_3, AllObjects_Object=meter_3)

not_4 = GateNot(A=value_list_5)
onoff_7 = EnableDisableObject(Enabled=value_list_5, AllObjects_Object=antal_4)
onoff_8 = EnableDisableObject(Enabled=not_4, AllObjects_Object=meter_4)

# Type 1
type_1 = ItemSelector(
    fundamenter_2.bygningsdel,
    {"12 / Gen. / Stål / Skruefundament", "12 / Gen. / Beton / Pælfundament", "12 / Gen. / Beton / Blokfundament, 1-5 etager", "12 / Gen. / Beton / Linjefundament, 1-5 etager"}, selected="12 / Gen. / Beton / Linjefundament, 1-5 etager")
element_type_picker_2 = ElementTypePicker(
    categories,
    {"Basic Wall : CL_W1": "e340d1fc-19c1-4200-9ff0-415bc126641d:e9d71ae9-50a0-4fd0-b533-dbc08decd09f-00092a3a", "Basic Wall : Cavity wall_sliders": "e340d1fc-19c1-4200-9ff0-415bc126641d:f565bef9-7d27-4781-b8d4-60f4a6034d87-000ce6a8", "Basic Wall : Exterior - Block on Mtl. Stud": "e340d1fc-19c1-4200-9ff0-415bc126641d:4d24d0d6-38f1-47b8-a376-b40c6432dad5-0000d50a", "Basic Wall : Exterior - Brick on Mtl. Stud": "e340d1fc-19c1-4200-9ff0-415bc126641d:e3e052f9-0156-11d5-9301-0000863f27ad-0000018d", "Basic Wall : Foundation - 300mm Concrete": "e340d1fc-19c1-4200-9ff0-415bc126641d:7f28cee1-b998-4a37-89e2-f58405cbbc56-0008df7c", "Basic Wall : Interior - 165 Partition (1-hr)": "e340d1fc-19c1-4200-9ff0-415bc126641d:88b03b05-80d3-484f-8022-471f61604c8d-00038d32", "Basic Wall : Interior - Partition": "e340d1fc-19c1-4200-9ff0-415bc126641d:88b03b05-80d3-484f-8022-471f61604c8d-00038d7b", "Basic Wall : Retaining - 300mm Concrete": "e340d1fc-19c1-4200-9ff0-415bc126641d:1551350c-45e5-41b8-bdf1-bcfa6794dc6a-000adce2", "Basic Wall : SIP 202mm Wall - conc clad": "e340d1fc-19c1-4200-9ff0-415bc126641d:c85e5be0-d8d5-4148-836f-b55e711ef373-00068b9b", "Basic Wall : Wall - Timber Clad": "e340d1fc-19c1-4200-9ff0-415bc126641d:ef57b02a-5e81-49e7-93bb-ae5f002d921c-000306df", "Curtain Wall : SH_Curtain wall": "e340d1fc-19c1-4200-9ff0-415bc126641d:6cbabf1d-e8d0-47f0-ac4d-9a7923128d37-000700af"}, selected="Basic Wall : CL_W1")

# ---- group: Dæk
# Type 1
element_type_picker_3 = ElementTypePicker(
    categories_4,
    {"Floor : Concrete-Domestic 425mm": "e340d1fc-19c1-4200-9ff0-415bc126641d:7f28cee1-b998-4a37-89e2-f58405cbbc56-0008df1d", "Floor : Generic 150mm": "e340d1fc-19c1-4200-9ff0-415bc126641d:e3e052f9-0156-11d5-9301-0000863f27ad-00000153", "Floor : Generic 300": "e340d1fc-19c1-4200-9ff0-415bc126641d:9c1f7993-9536-44bd-bedc-bf731228f65b-00072966", "Floor : Insitu Concrete 225mm": "e340d1fc-19c1-4200-9ff0-415bc126641d:7f28cee1-b998-4a37-89e2-f58405cbbc56-0008defb", "Floor : Timber Suspended Floor": "e340d1fc-19c1-4200-9ff0-415bc126641d:203cff26-4c9d-4eb4-93e5-28d28a01f256-0002d338"}, selected=["Floor : Generic 300", "Floor : Timber Suspended Floor"])

# ---- group: Terrændæk
# Type 1
element_type_picker_4 = ElementTypePicker(
    categories_4,
    {"Floor : Concrete-Domestic 425mm": "e340d1fc-19c1-4200-9ff0-415bc126641d:7f28cee1-b998-4a37-89e2-f58405cbbc56-0008df1d", "Floor : Generic 150mm": "e340d1fc-19c1-4200-9ff0-415bc126641d:e3e052f9-0156-11d5-9301-0000863f27ad-00000153", "Floor : Generic 300": "e340d1fc-19c1-4200-9ff0-415bc126641d:9c1f7993-9536-44bd-bedc-bf731228f65b-00072966", "Floor : Insitu Concrete 225mm": "e340d1fc-19c1-4200-9ff0-415bc126641d:7f28cee1-b998-4a37-89e2-f58405cbbc56-0008defb", "Floor : Timber Suspended Floor": "e340d1fc-19c1-4200-9ff0-415bc126641d:203cff26-4c9d-4eb4-93e5-28d28a01f256-0002d338"}, selected="Floor : Generic 150mm")

# ---- group: Vinduer, Døre og Glasfacader
# Type 1
element_type_picker_5 = ElementTypePicker(
    categories_6,
    {"Curtain Wall Dbl Glass : Curtain Wall Dbl Glass": "e340d1fc-19c1-4200-9ff0-415bc126641d:dda0c528-df04-4b54-b52b-7838a5b0f937-000de602", "Entrance door : Entrance door": "e340d1fc-19c1-4200-9ff0-415bc126641d:509d6b54-1e50-4817-a949-85fb3ed021b2-000d3739", "M_Double-Flush : 1730 x 2134mm": "e340d1fc-19c1-4200-9ff0-415bc126641d:b3a4a465-08e5-441a-bd3e-d967e546d52e-000dd959", "Pocket_Slider_Door_5851 : 2.027 x 0.945": "e340d1fc-19c1-4200-9ff0-415bc126641d:96834e54-f091-4317-9b1a-bbe8b647201d-0007b7fe", "Single-Flush : 800 x 2100": "e340d1fc-19c1-4200-9ff0-415bc126641d:88b03b05-80d3-484f-8022-471f61604c8d-00038d4c"}, selected="Entrance door : Entrance door")

# ---- group: Tage
# Type 1
element_type_picker_6 = ElementTypePicker(
    categories_2,
    {"Basic Roof : SG Metal Panels roof": "e340d1fc-19c1-4200-9ff0-415bc126641d:96834e54-f091-4317-9b1a-bbe8b647201d-0007bc90", "Basic Roof : Warm Roof - Timber": "e340d1fc-19c1-4200-9ff0-415bc126641d:1551350c-45e5-41b8-bdf1-bcfa6794dc6a-000adc85", "Sloped Glazing : Sloped Glazing": "e340d1fc-19c1-4200-9ff0-415bc126641d:e3e052f9-0156-11d5-9301-0000863f27ad-00000152"}, selected=["Basic Roof : SG Metal Panels roof", "Basic Roof : Warm Roof - Timber"])

# ---- group: Fundamenter
# Type 2
type_2 = ItemSelector(
    fundamenter_2.bygningsdel,
    {"12 / Gen. / Stål / Skruefundament", "12 / Gen. / Beton / Pælfundament", "12 / Gen. / Beton / Blokfundament, 1-5 etager", "12 / Gen. / Beton / Linjefundament, 1-5 etager"}, selected="12 / Gen. / Beton / Blokfundament, 1-5 etager")  # disabled

exclude = Exclude(C=categories, E=element_type_picker_2)
type_1_2 = Type1_2(T=element_type_picker_2, L=antal_elementer_der_tælles_med_i_query_e)  # -> G, L_2, R
gwp = GWP(L=fundamenter_2.gwp, S=type_1, M=fundamenter_2.bygningsdel)
gwp_2 = GWP(L=fundamenter_2.gwp, S=type_2, M=fundamenter_2.bygningsdel)
antal = Number(type_1_2.L_2)  # disabled
geo = Geometry(type_1_2.G)
geo_2 = Geometry(geo)
meter = Number(type_1_2.R)
multiplication_4 = Multiplication(A=gwp, B=[meter, antal])
gwp_type_1_1m2 = Panel(gwp)
gwp_type_1_1m2_2 = Panel(gwp_2)
type_1_3 = Type1_3(gwp=multiplication_4, meter=meter, antal=antal)  # -> mængde, gwp_2

preview = CustomPreview(Geometry=geo_2, Material=ColourSwatch(SwatchColor=RGB(255, 212, 0)))

# ---- group: Terrændæk
# Type 2
exclude_2 = Exclude(C=categories_4, E=element_type_picker_4)
element_type_picker_7 = ElementTypePicker(
    exclude_2,
    {"Floor : Concrete-Domestic 425mm": "e340d1fc-19c1-4200-9ff0-415bc126641d:7f28cee1-b998-4a37-89e2-f58405cbbc56-0008df1d", "Floor : Generic 150mm": "e340d1fc-19c1-4200-9ff0-415bc126641d:e3e052f9-0156-11d5-9301-0000863f27ad-00000153", "Floor : Generic 300": "e340d1fc-19c1-4200-9ff0-415bc126641d:9c1f7993-9536-44bd-bedc-bf731228f65b-00072966", "Floor : Insitu Concrete 225mm": "e340d1fc-19c1-4200-9ff0-415bc126641d:7f28cee1-b998-4a37-89e2-f58405cbbc56-0008defb", "Floor : Timber Suspended Floor": "e340d1fc-19c1-4200-9ff0-415bc126641d:203cff26-4c9d-4eb4-93e5-28d28a01f256-0002d338"}, selected=[])  # disabled

# ---- group: Vinduer, Døre og Glasfacader
# Type 2
exclude_3 = Exclude(C=categories_6, E=element_type_picker_5)
element_type_picker_8 = ElementTypePicker(
    exclude_3,
    {"Curtain Wall Dbl Glass : Curtain Wall Dbl Glass": "e340d1fc-19c1-4200-9ff0-415bc126641d:dda0c528-df04-4b54-b52b-7838a5b0f937-000de602", "M_Double-Flush : 1730 x 2134mm": "e340d1fc-19c1-4200-9ff0-415bc126641d:b3a4a465-08e5-441a-bd3e-d967e546d52e-000dd959", "Pocket_Slider_Door_5851 : 2.027 x 0.945": "e340d1fc-19c1-4200-9ff0-415bc126641d:96834e54-f091-4317-9b1a-bbe8b647201d-0007b7fe", "Single-Flush : 800 x 2100": "e340d1fc-19c1-4200-9ff0-415bc126641d:88b03b05-80d3-484f-8022-471f61604c8d-00038d4c"}, selected=["M_Double-Flush : 1730 x 2134mm", "Pocket_Slider_Door_5851 : 2.027 x 0.945", "Single-Flush : 800 x 2100"])

# ---- group: Dæk
# Type 2
exclude_4 = Exclude(C=categories_4, E=element_type_picker_3)
element_type_picker_9 = ElementTypePicker(
    exclude_4,
    {"Floor : Concrete-Domestic 425mm": "e340d1fc-19c1-4200-9ff0-415bc126641d:7f28cee1-b998-4a37-89e2-f58405cbbc56-0008df1d", "Floor : Generic 150mm": "e340d1fc-19c1-4200-9ff0-415bc126641d:e3e052f9-0156-11d5-9301-0000863f27ad-00000153", "Floor : Insitu Concrete 225mm": "e340d1fc-19c1-4200-9ff0-415bc126641d:7f28cee1-b998-4a37-89e2-f58405cbbc56-0008defb"}, selected=[])  # disabled

# ---- group: Yder- & Indervægge
# Type 2
value_list_6 = ValueList({"Indervæg": False, "Ydervæg": True}, selected="Ydervæg")
exclude_5 = Exclude(C=categories, E=element_type_picker)
element_type_picker_10 = ElementTypePicker(
    exclude_5,
    {"Basic Wall : CL_W1": "e340d1fc-19c1-4200-9ff0-415bc126641d:e9d71ae9-50a0-4fd0-b533-dbc08decd09f-00092a3a", "Basic Wall : Cavity wall_sliders": "e340d1fc-19c1-4200-9ff0-415bc126641d:f565bef9-7d27-4781-b8d4-60f4a6034d87-000ce6a8", "Basic Wall : Exterior - Block on Mtl. Stud": "e340d1fc-19c1-4200-9ff0-415bc126641d:4d24d0d6-38f1-47b8-a376-b40c6432dad5-0000d50a", "Basic Wall : Exterior - Brick on Mtl. Stud": "e340d1fc-19c1-4200-9ff0-415bc126641d:e3e052f9-0156-11d5-9301-0000863f27ad-0000018d", "Basic Wall : Foundation - 300mm Concrete": "e340d1fc-19c1-4200-9ff0-415bc126641d:7f28cee1-b998-4a37-89e2-f58405cbbc56-0008df7c", "Basic Wall : Retaining - 300mm Concrete": "e340d1fc-19c1-4200-9ff0-415bc126641d:1551350c-45e5-41b8-bdf1-bcfa6794dc6a-000adce2", "Basic Wall : SIP 202mm Wall - conc clad": "e340d1fc-19c1-4200-9ff0-415bc126641d:c85e5be0-d8d5-4148-836f-b55e711ef373-00068b9b", "Basic Wall : Wall - Timber Clad": "e340d1fc-19c1-4200-9ff0-415bc126641d:ef57b02a-5e81-49e7-93bb-ae5f002d921c-000306df", "Curtain Wall : SH_Curtain wall": "e340d1fc-19c1-4200-9ff0-415bc126641d:6cbabf1d-e8d0-47f0-ac4d-9a7923128d37-000700af"}, selected=["Basic Wall : Cavity wall_sliders", "Basic Wall : Exterior - Block on Mtl. Stud", "Basic Wall : Exterior - Brick on Mtl. Stud", "Basic Wall : SIP 202mm Wall - conc clad", "Basic Wall : Wall - Timber Clad"])

# ---- group: Tage
# Type 2
exclude_6 = Exclude(C=categories_2, E=element_type_picker_6)
element_type_picker_11 = ElementTypePicker(
    exclude_6,
    {"Sloped Glazing : Sloped Glazing": "e340d1fc-19c1-4200-9ff0-415bc126641d:e3e052f9-0156-11d5-9301-0000863f27ad-00000152"}, selected=[])  # disabled

# ---- group: Fundamenter (continued)
element_type_picker_12 = ElementTypePicker(
    exclude,
    {"Basic Wall : Cavity wall_sliders": "e340d1fc-19c1-4200-9ff0-415bc126641d:f565bef9-7d27-4781-b8d4-60f4a6034d87-000ce6a8", "Basic Wall : Exterior - Block on Mtl. Stud": "e340d1fc-19c1-4200-9ff0-415bc126641d:4d24d0d6-38f1-47b8-a376-b40c6432dad5-0000d50a", "Basic Wall : Exterior - Brick on Mtl. Stud": "e340d1fc-19c1-4200-9ff0-415bc126641d:e3e052f9-0156-11d5-9301-0000863f27ad-0000018d", "Basic Wall : Interior - 165 Partition (1-hr)": "e340d1fc-19c1-4200-9ff0-415bc126641d:88b03b05-80d3-484f-8022-471f61604c8d-00038d32", "Basic Wall : Interior - Partition": "e340d1fc-19c1-4200-9ff0-415bc126641d:88b03b05-80d3-484f-8022-471f61604c8d-00038d7b", "Basic Wall : SIP 202mm Wall - conc clad": "e340d1fc-19c1-4200-9ff0-415bc126641d:c85e5be0-d8d5-4148-836f-b55e711ef373-00068b9b", "Basic Wall : Wall - Timber Clad": "e340d1fc-19c1-4200-9ff0-415bc126641d:ef57b02a-5e81-49e7-93bb-ae5f002d921c-000306df", "Curtain Wall : SH_Curtain wall": "e340d1fc-19c1-4200-9ff0-415bc126641d:6cbabf1d-e8d0-47f0-ac4d-9a7923128d37-000700af"}, selected=[])  # disabled

# Type 3
type_3 = ItemSelector(
    fundamenter_2.bygningsdel,
    {"12 / Gen. / Stål / Skruefundament", "12 / Gen. / Beton / Pælfundament", "12 / Gen. / Beton / Blokfundament, 1-5 etager", "12 / Gen. / Beton / Linjefundament, 1-5 etager"}, selected="12 / Gen. / Stål / Skruefundament")  # disabled

exclude_7 = Exclude(C=categories, E=[element_type_picker_2, element_type_picker_12])
type_1_4 = Type1_2(T=element_type_picker_12, L=antal_elementer_der_tælles_med_i_query_e)  # -> G, L_2, R
gwp_3 = GWP(L=fundamenter_2.gwp, S=type_3, M=fundamenter_2.bygningsdel)
geo_3 = Geometry(type_1_4.G)
geo_4 = Geometry(geo_3)
antal_2 = Number(type_1_4.L_2)
meter_2 = Number(type_1_4.R)  # disabled
multiplication_5 = Multiplication(A=gwp_2, B=[meter_2, antal_2])
gwp_type_1_1m2_3 = Panel(gwp_3)
type_2_2 = Type1_3(gwp=multiplication_5, meter=meter_2, antal=antal_2)  # -> mængde, gwp_2

preview_2 = CustomPreview(Geometry=geo_4, Material=ColourSwatch(SwatchColor=RGB(217, 181, 0)))

# ---- group: Vinduer, Døre og Glasfacader
# Type 3
exclude_8 = Exclude(C=categories_6, E=[element_type_picker_5, element_type_picker_8])
element_type_picker_13 = ElementTypePicker(
    exclude_8,
    {"Curtain Wall Dbl Glass : Curtain Wall Dbl Glass": "e340d1fc-19c1-4200-9ff0-415bc126641d:dda0c528-df04-4b54-b52b-7838a5b0f937-000de602"}, selected="Curtain Wall Dbl Glass : Curtain Wall Dbl Glass")

# ---- group: Terrændæk
# Type 3
exclude_9 = Exclude(C=categories_4, E=[element_type_picker_4, element_type_picker_7])
element_type_picker_14 = ElementTypePicker(
    exclude_9,
    {"Floor : Concrete-Domestic 425mm": "e340d1fc-19c1-4200-9ff0-415bc126641d:7f28cee1-b998-4a37-89e2-f58405cbbc56-0008df1d", "Floor : Generic 150mm": "e340d1fc-19c1-4200-9ff0-415bc126641d:e3e052f9-0156-11d5-9301-0000863f27ad-00000153", "Floor : Generic 300": "e340d1fc-19c1-4200-9ff0-415bc126641d:9c1f7993-9536-44bd-bedc-bf731228f65b-00072966", "Floor : Insitu Concrete 225mm": "e340d1fc-19c1-4200-9ff0-415bc126641d:7f28cee1-b998-4a37-89e2-f58405cbbc56-0008defb", "Floor : Timber Suspended Floor": "e340d1fc-19c1-4200-9ff0-415bc126641d:203cff26-4c9d-4eb4-93e5-28d28a01f256-0002d338"}, selected=[])  # disabled

# ---- group: Yder- & Indervægge
# Type 3
value_list_7 = ValueList({"Indervæg": False, "Ydervæg": True}, selected="Ydervæg")
exclude_10 = Exclude(C=categories, E=[element_type_picker, element_type_picker_10])
element_type_picker_15 = ElementTypePicker(
    exclude_10,
    {"Basic Wall : CL_W1": "e340d1fc-19c1-4200-9ff0-415bc126641d:e9d71ae9-50a0-4fd0-b533-dbc08decd09f-00092a3a", "Curtain Wall : SH_Curtain wall": "e340d1fc-19c1-4200-9ff0-415bc126641d:6cbabf1d-e8d0-47f0-ac4d-9a7923128d37-000700af"}, selected=[])  # disabled

# ---- group: Dæk
# Type 3
exclude_11 = Exclude(C=categories_4, E=[element_type_picker_3, element_type_picker_9])
element_type_picker_16 = ElementTypePicker(
    exclude_11,
    {"Floor : Concrete-Domestic 425mm": "e340d1fc-19c1-4200-9ff0-415bc126641d:7f28cee1-b998-4a37-89e2-f58405cbbc56-0008df1d", "Floor : Generic 150mm": "e340d1fc-19c1-4200-9ff0-415bc126641d:e3e052f9-0156-11d5-9301-0000863f27ad-00000153", "Floor : Insitu Concrete 225mm": "e340d1fc-19c1-4200-9ff0-415bc126641d:7f28cee1-b998-4a37-89e2-f58405cbbc56-0008defb"}, selected=[])  # disabled

# ---- group: Tage
# Type 3
exclude_12 = Exclude(C=categories_2, E=[element_type_picker_6, element_type_picker_11])
element_type_picker_17 = ElementTypePicker(
    exclude_12,
    {"Sloped Glazing : Sloped Glazing": "e340d1fc-19c1-4200-9ff0-415bc126641d:e3e052f9-0156-11d5-9301-0000863f27ad-00000152"}, selected=[])  # disabled

# ---- group: Fundamenter (continued)
element_type_picker_18 = ElementTypePicker(
    exclude_7,
    {"Basic Wall : 200 mm - forsatsvæg": "2da26c2f-dbf3-4fed-ac22-e2badea7c200:5f72f12c-3573-4c9b-a0d2-f435488dbf15-006e8fca", "Basic Wall : 450 mm - Fundament": "2da26c2f-dbf3-4fed-ac22-e2badea7c200:0fc343f6-07cd-4e85-8cc1-1dfe2c8eba08-0067ec46", "Basic Wall : 50 mm glasvæg": "2da26c2f-dbf3-4fed-ac22-e2badea7c200:9471da9a-ee0c-435a-85d4-d8f4fed1df42-006af760", "Basic Wall : 500 mm - Generic": "2da26c2f-dbf3-4fed-ac22-e2badea7c200:10ac24d6-d1d6-49e7-b00d-250489df36fc-0061050e", "Basic Wall : 83 mm - Generic": "2da26c2f-dbf3-4fed-ac22-e2badea7c200:4945ded3-b2a7-43c5-a198-3c815c2b82cc-006270c6", "Basic Wall : Basic Wall": "2da26c2f-dbf3-4fed-ac22-e2badea7c200:30c04db5-ba7f-4e89-a4bf-a6a45373be9c-00019e3f", "Basic Wall : L%AD01 - Ydervæg 470 mm - Generic": "2da26c2f-dbf3-4fed-ac22-e2badea7c200:d155caea-45dd-49e0-99a7-20e91f8423f3-0060e2c8", "Basic Wall : L%AD10 - Boligskel 240 mm - Generic": "2da26c2f-dbf3-4fed-ac22-e2badea7c200:e778b591-ca7a-4079-83bb-c2e1cfbc05ff-00612d7b", "Basic Wall : L%AD11 - Indervæg bærende 150 mm - Generic": "2da26c2f-dbf3-4fed-ac22-e2badea7c200:10ac24d6-d1d6-49e7-b00d-250489df36fc-00610264", "Basic Wall : L%AD12 - Indervæg - Skillevæg 120 mm - Generic": "2da26c2f-dbf3-4fed-ac22-e2badea7c200:705fe388-8f22-4606-a1fa-1ed455738780-006145a9", "Basic Wall : L%AD13 - Indervæg - Skillevæg 200 mm - Generic": "2da26c2f-dbf3-4fed-ac22-e2badea7c200:705fe388-8f22-4606-a1fa-1ed455738780-006144bd", "Basic Wall : L%ADXX - Indervæg 100 mm - Generic": "2da26c2f-dbf3-4fed-ac22-e2badea7c200:58318396-9780-4024-b2c1-a7b70664c979-006d6907", "Curtain Wall : Curtain Wall": "2da26c2f-dbf3-4fed-ac22-e2badea7c200:e3e052f9-0156-11d5-9301-0000863f27ad-0000014e"}, selected="Basic Wall : 450 mm - Fundament")  # disabled

# ---- group: Resultat / Analyse af resultat
num_7 = Number(drift_2)

# ---- group: Fundamenter
# Type 4
type_4 = ItemSelector(
    fundamenter_2.bygningsdel,
    {"12 / Gen. / Stål / Skruefundament", "12 / Gen. / Beton / Pælfundament", "12 / Gen. / Beton / Blokfundament, 1-5 etager", "12 / Gen. / Beton / Linjefundament, 1-5 etager"}, selected="12 / Gen. / Beton / Pælfundament")  # disabled

# ---- group: Resultat / Analyse af resultat (continued)
bygningsdele = Data([type_1, type_2, type_3, type_4])

# ---- group: Fundamenter (continued)
exclude_13 = Exclude(C=categories, E=[element_type_picker_2, element_type_picker_12, element_type_picker_18])
type_1_5 = Type1_2(T=element_type_picker_18, L=antal_elementer_der_tælles_med_i_query_e)  # -> G, L_2, R
gwp_4 = GWP(L=fundamenter_2.gwp, S=type_4, M=fundamenter_2.bygningsdel)
geo_5 = Geometry(type_1_5.G)
geo_6 = Geometry(geo_5)
antal_3 = Number(type_1_5.L_2)
meter_3 = Number(type_1_5.R)  # disabled
multiplication_6 = Multiplication(A=gwp_3, B=[meter_3, antal_3])
gwp_type_1_1m2_4 = Panel(gwp_4)
type_3_2 = Type1_3(gwp=multiplication_6, meter=meter_3, antal=antal_3)  # -> mængde, gwp_2

preview_3 = CustomPreview(Geometry=geo_6, Material=ColourSwatch(SwatchColor=RGB(178, 149, 0)))

# ---- group: Vinduer, Døre og Glasfacader
# Type 4
exclude_14 = Exclude(C=categories_6, E=[element_type_picker_5, element_type_picker_8, element_type_picker_13])
element_type_picker_19 = ElementTypePicker(exclude_14)  # disabled

# ---- group: Yder- & Indervægge
# Type 4
value_list_8 = ValueList({"Indervæg": False, "Ydervæg": True}, selected="Ydervæg")  # disabled
exclude_15 = Exclude(C=categories, E=[element_type_picker, element_type_picker_10, element_type_picker_15])
element_type_picker_20 = ElementTypePicker(
    exclude_15,
    {"Basic Wall : CL_W1": "e340d1fc-19c1-4200-9ff0-415bc126641d:e9d71ae9-50a0-4fd0-b533-dbc08decd09f-00092a3a", "Curtain Wall : SH_Curtain wall": "e340d1fc-19c1-4200-9ff0-415bc126641d:6cbabf1d-e8d0-47f0-ac4d-9a7923128d37-000700af"}, selected=[])  # disabled

# ---- group: Terrændæk
# Type 4
exclude_16 = Exclude(C=categories_4, E=[element_type_picker_4, element_type_picker_7, element_type_picker_14])
element_type_picker_21 = ElementTypePicker(
    exclude_16,
    {"Floor : Concrete-Domestic 425mm": "e340d1fc-19c1-4200-9ff0-415bc126641d:7f28cee1-b998-4a37-89e2-f58405cbbc56-0008df1d", "Floor : Generic 150mm": "e340d1fc-19c1-4200-9ff0-415bc126641d:e3e052f9-0156-11d5-9301-0000863f27ad-00000153", "Floor : Generic 300": "e340d1fc-19c1-4200-9ff0-415bc126641d:9c1f7993-9536-44bd-bedc-bf731228f65b-00072966", "Floor : Insitu Concrete 225mm": "e340d1fc-19c1-4200-9ff0-415bc126641d:7f28cee1-b998-4a37-89e2-f58405cbbc56-0008defb", "Floor : Timber Suspended Floor": "e340d1fc-19c1-4200-9ff0-415bc126641d:203cff26-4c9d-4eb4-93e5-28d28a01f256-0002d338"}, selected=[])  # disabled

# ---- group: Dæk
# Type 4
exclude_17 = Exclude(C=categories_4, E=[element_type_picker_3, element_type_picker_9, element_type_picker_16])
element_type_picker_22 = ElementTypePicker(
    exclude_17,
    {"Floor : Concrete-Domestic 425mm": "e340d1fc-19c1-4200-9ff0-415bc126641d:7f28cee1-b998-4a37-89e2-f58405cbbc56-0008df1d", "Floor : Generic 150mm": "e340d1fc-19c1-4200-9ff0-415bc126641d:e3e052f9-0156-11d5-9301-0000863f27ad-00000153", "Floor : Insitu Concrete 225mm": "e340d1fc-19c1-4200-9ff0-415bc126641d:7f28cee1-b998-4a37-89e2-f58405cbbc56-0008defb"}, selected=[])  # disabled

# ---- group: Tage
# Type 4
exclude_18 = Exclude(C=categories_2, E=[element_type_picker_6, element_type_picker_11, element_type_picker_17])
element_type_picker_23 = ElementTypePicker(
    exclude_18,
    {"Sloped Glazing : Sloped Glazing": "e340d1fc-19c1-4200-9ff0-415bc126641d:e3e052f9-0156-11d5-9301-0000863f27ad-00000152"}, selected=[])  # disabled

# ---- group: Fundamenter (continued)
element_type_picker_24 = ElementTypePicker(
    exclude_13,
    {"Basic Wall : 200 mm - forsatsvæg": "2da26c2f-dbf3-4fed-ac22-e2badea7c200:5f72f12c-3573-4c9b-a0d2-f435488dbf15-006e8fca", "Basic Wall : 450 mm - Fundament": "2da26c2f-dbf3-4fed-ac22-e2badea7c200:0fc343f6-07cd-4e85-8cc1-1dfe2c8eba08-0067ec46", "Basic Wall : 50 mm glasvæg": "2da26c2f-dbf3-4fed-ac22-e2badea7c200:9471da9a-ee0c-435a-85d4-d8f4fed1df42-006af760", "Basic Wall : 500 mm - Generic": "2da26c2f-dbf3-4fed-ac22-e2badea7c200:10ac24d6-d1d6-49e7-b00d-250489df36fc-0061050e", "Basic Wall : 83 mm - Generic": "2da26c2f-dbf3-4fed-ac22-e2badea7c200:4945ded3-b2a7-43c5-a198-3c815c2b82cc-006270c6", "Basic Wall : Basic Wall": "2da26c2f-dbf3-4fed-ac22-e2badea7c200:30c04db5-ba7f-4e89-a4bf-a6a45373be9c-00019e3f", "Basic Wall : L%AD01 - Ydervæg 470 mm - Generic": "2da26c2f-dbf3-4fed-ac22-e2badea7c200:d155caea-45dd-49e0-99a7-20e91f8423f3-0060e2c8", "Basic Wall : L%AD10 - Boligskel 240 mm - Generic": "2da26c2f-dbf3-4fed-ac22-e2badea7c200:e778b591-ca7a-4079-83bb-c2e1cfbc05ff-00612d7b", "Basic Wall : L%AD11 - Indervæg bærende 150 mm - Generic": "2da26c2f-dbf3-4fed-ac22-e2badea7c200:10ac24d6-d1d6-49e7-b00d-250489df36fc-00610264", "Basic Wall : L%AD12 - Indervæg - Skillevæg 120 mm - Generic": "2da26c2f-dbf3-4fed-ac22-e2badea7c200:705fe388-8f22-4606-a1fa-1ed455738780-006145a9", "Basic Wall : L%AD13 - Indervæg - Skillevæg 200 mm - Generic": "2da26c2f-dbf3-4fed-ac22-e2badea7c200:705fe388-8f22-4606-a1fa-1ed455738780-006144bd", "Basic Wall : L%ADXX - Indervæg 100 mm - Generic": "2da26c2f-dbf3-4fed-ac22-e2badea7c200:58318396-9780-4024-b2c1-a7b70664c979-006d6907", "Curtain Wall : Curtain Wall": "2da26c2f-dbf3-4fed-ac22-e2badea7c200:e3e052f9-0156-11d5-9301-0000863f27ad-0000014e"}, selected="Basic Wall : 450 mm - Fundament")  # disabled

cluster_2 = Cluster(E=elements.Elements, E_2=[element_type_picker_2, element_type_picker_12, element_type_picker_18, element_type_picker_24])
type_1_6 = Type1_2(T=element_type_picker_24, L=antal_elementer_der_tælles_med_i_query_e)  # -> G, L_2, R
overskydende_revit_elementer = Panel(cluster_2)
geo_7 = Geometry(type_1_6.G)
geo_8 = Geometry(geo_7)
antal_4 = Number(type_1_6.L_2)
meter_4 = Number(type_1_6.R)  # disabled
multiplication_7 = Multiplication(A=gwp_4, B=[meter_4, antal_4])
type_4_2 = Type1_3(gwp=multiplication_7, meter=meter_4, antal=antal_4)  # -> mængde, gwp_2
addition_2 = Addition(Type1=multiplication_4, Type2=multiplication_5, Type3=multiplication_6, Type4=multiplication_7)
entwine = Entwine(
    Branch00=[type_1, type_1_3.gwp_2, type_1_3.mængde],
    Branch01=[type_2, type_2_2.gwp_2, type_2_2.mængde],
    Branch02=[type_3, type_3_2.gwp_2, type_3_2.mængde],
    Branch03=[type_4, type_4_2.gwp_2, type_4_2.mængde],
    FlattenInputs=True)
samlet_co2_eq_for_fundamenter = Panel(addition_2)
samlet_co2_eq_pr_bygningsdel = Panel(entwine)

preview_4 = CustomPreview(Geometry=geo_8, Material=ColourSwatch(SwatchColor=RGB(140, 117, 0)))

# ---- group: Resultat / Udregning af resultat (continued)
num_8 = Number(addition_2)

# ---- group: Dæk
# Type 5
exclude_19 = Exclude(C=categories_4, E=[element_type_picker_3, element_type_picker_9, element_type_picker_16, element_type_picker_22])
element_type_picker_25 = ElementTypePicker(
    exclude_19,
    {"Floor : Concrete-Domestic 425mm": "e340d1fc-19c1-4200-9ff0-415bc126641d:7f28cee1-b998-4a37-89e2-f58405cbbc56-0008df1d", "Floor : Generic 150mm": "e340d1fc-19c1-4200-9ff0-415bc126641d:e3e052f9-0156-11d5-9301-0000863f27ad-00000153", "Floor : Insitu Concrete 225mm": "e340d1fc-19c1-4200-9ff0-415bc126641d:7f28cee1-b998-4a37-89e2-f58405cbbc56-0008defb"}, selected=[])  # disabled

# ---- group: Yder- & Indervægge
# Type 5
value_list_9 = ValueList({"Indervæg": False, "Ydervæg": True}, selected="Ydervæg")  # disabled
exclude_20 = Exclude(C=categories, E=[element_type_picker, element_type_picker_10, element_type_picker_15, element_type_picker_20])
element_type_picker_26 = ElementTypePicker(
    exclude_20,
    {"Basic Wall : CL_W1": "e340d1fc-19c1-4200-9ff0-415bc126641d:e9d71ae9-50a0-4fd0-b533-dbc08decd09f-00092a3a", "Curtain Wall : SH_Curtain wall": "e340d1fc-19c1-4200-9ff0-415bc126641d:6cbabf1d-e8d0-47f0-ac4d-9a7923128d37-000700af"}, selected=[])  # disabled

# ---- group: Terrændæk
# Type 5
exclude_21 = Exclude(C=categories_4, E=[element_type_picker_4, element_type_picker_7, element_type_picker_14, element_type_picker_21])
element_type_picker_27 = ElementTypePicker(
    exclude_21,
    {"Floor : Concrete-Domestic 425mm": "e340d1fc-19c1-4200-9ff0-415bc126641d:7f28cee1-b998-4a37-89e2-f58405cbbc56-0008df1d", "Floor : Generic 150mm": "e340d1fc-19c1-4200-9ff0-415bc126641d:e3e052f9-0156-11d5-9301-0000863f27ad-00000153", "Floor : Generic 300": "e340d1fc-19c1-4200-9ff0-415bc126641d:9c1f7993-9536-44bd-bedc-bf731228f65b-00072966", "Floor : Insitu Concrete 225mm": "e340d1fc-19c1-4200-9ff0-415bc126641d:7f28cee1-b998-4a37-89e2-f58405cbbc56-0008defb", "Floor : Timber Suspended Floor": "e340d1fc-19c1-4200-9ff0-415bc126641d:203cff26-4c9d-4eb4-93e5-28d28a01f256-0002d338"}, selected=[])  # disabled

# ---- group: Tage
# Type 5
exclude_22 = Exclude(C=categories_2, E=[element_type_picker_6, element_type_picker_11, element_type_picker_17, element_type_picker_23])
element_type_picker_28 = ElementTypePicker(
    exclude_22,
    {"Sloped Glazing : Sloped Glazing": "e340d1fc-19c1-4200-9ff0-415bc126641d:e3e052f9-0156-11d5-9301-0000863f27ad-00000152"}, selected=[])  # disabled

# ---- group: Vinduer, Døre og Glasfacader
# Vinduer
element_type_picker_29 = ElementTypePicker(
    categories_5,
    {"M_Skylight : 1180 x 1170mm": "e340d1fc-19c1-4200-9ff0-415bc126641d:4269d745-d78a-4cca-860f-a55b170715ad-000775a0", "Single Window : Standard": "e340d1fc-19c1-4200-9ff0-415bc126641d:ef57b02a-5e81-49e7-93bb-ae5f002d921c-000306de"}, selected=["M_Skylight : 1180 x 1170mm", "Single Window : Standard"])
swatch = ColourSwatch(SwatchColor=RGBA(233, 236, 240, 80))

# ---- group: Yder- & Indervægge
# Type 6
value_list_10 = ValueList({"Indervæg": False, "Ydervæg": True}, selected="Indervæg")  # disabled
exclude_23 = Exclude(
    C=categories,
    E=[element_type_picker_26, element_type_picker, element_type_picker_10, element_type_picker_15, element_type_picker_20])
element_type_picker_30 = ElementTypePicker(
    exclude_23,
    {"Basic Wall : CL_W1": "e340d1fc-19c1-4200-9ff0-415bc126641d:e9d71ae9-50a0-4fd0-b533-dbc08decd09f-00092a3a", "Curtain Wall : SH_Curtain wall": "e340d1fc-19c1-4200-9ff0-415bc126641d:6cbabf1d-e8d0-47f0-ac4d-9a7923128d37-000700af"}, selected=[])  # disabled

# ---- group: Terrændæk
# Type 6
exclude_24 = Exclude(
    C=categories_4,
    E=[element_type_picker_4, element_type_picker_7, element_type_picker_14, element_type_picker_21, element_type_picker_27])
element_type_picker_31 = ElementTypePicker(
    exclude_24,
    {"Floor : Concrete-Domestic 425mm": "e340d1fc-19c1-4200-9ff0-415bc126641d:7f28cee1-b998-4a37-89e2-f58405cbbc56-0008df1d", "Floor : Generic 150mm": "e340d1fc-19c1-4200-9ff0-415bc126641d:e3e052f9-0156-11d5-9301-0000863f27ad-00000153", "Floor : Generic 300": "e340d1fc-19c1-4200-9ff0-415bc126641d:9c1f7993-9536-44bd-bedc-bf731228f65b-00072966", "Floor : Insitu Concrete 225mm": "e340d1fc-19c1-4200-9ff0-415bc126641d:7f28cee1-b998-4a37-89e2-f58405cbbc56-0008defb", "Floor : Timber Suspended Floor": "e340d1fc-19c1-4200-9ff0-415bc126641d:203cff26-4c9d-4eb4-93e5-28d28a01f256-0002d338"}, selected=[])  # disabled

# ---- group: Dæk
# Type 6
exclude_25 = Exclude(
    C=categories_4,
    E=[element_type_picker_3, element_type_picker_9, element_type_picker_16, element_type_picker_22, element_type_picker_25])
element_type_picker_32 = ElementTypePicker(
    exclude_25,
    {"Floor : Concrete-Domestic 425mm": "e340d1fc-19c1-4200-9ff0-415bc126641d:7f28cee1-b998-4a37-89e2-f58405cbbc56-0008df1d", "Floor : Generic 150mm": "e340d1fc-19c1-4200-9ff0-415bc126641d:e3e052f9-0156-11d5-9301-0000863f27ad-00000153", "Floor : Insitu Concrete 225mm": "e340d1fc-19c1-4200-9ff0-415bc126641d:7f28cee1-b998-4a37-89e2-f58405cbbc56-0008defb"}, selected=[])  # disabled

# ---- group: Tage
# Type 6
exclude_26 = Exclude(
    C=categories_2,
    E=[element_type_picker_6, element_type_picker_11, element_type_picker_17, element_type_picker_23, element_type_picker_28])
element_type_picker_33 = ElementTypePicker(
    exclude_26,
    {"Sloped Glazing : Sloped Glazing": "e340d1fc-19c1-4200-9ff0-415bc126641d:e3e052f9-0156-11d5-9301-0000863f27ad-00000152"}, selected=[])  # disabled

# ---- group: Vinduer, Døre og Glasfacader
# Glasvæg
element_type_picker_34 = ElementTypePicker(
    categories,
    {"Basic Wall : CL_W1": "e340d1fc-19c1-4200-9ff0-415bc126641d:e9d71ae9-50a0-4fd0-b533-dbc08decd09f-00092a3a", "Basic Wall : Cavity wall_sliders": "e340d1fc-19c1-4200-9ff0-415bc126641d:f565bef9-7d27-4781-b8d4-60f4a6034d87-000ce6a8", "Basic Wall : Exterior - Block on Mtl. Stud": "e340d1fc-19c1-4200-9ff0-415bc126641d:4d24d0d6-38f1-47b8-a376-b40c6432dad5-0000d50a", "Basic Wall : Exterior - Brick on Mtl. Stud": "e340d1fc-19c1-4200-9ff0-415bc126641d:e3e052f9-0156-11d5-9301-0000863f27ad-0000018d", "Basic Wall : Foundation - 300mm Concrete": "e340d1fc-19c1-4200-9ff0-415bc126641d:7f28cee1-b998-4a37-89e2-f58405cbbc56-0008df7c", "Basic Wall : Interior - 165 Partition (1-hr)": "e340d1fc-19c1-4200-9ff0-415bc126641d:88b03b05-80d3-484f-8022-471f61604c8d-00038d32", "Basic Wall : Interior - Partition": "e340d1fc-19c1-4200-9ff0-415bc126641d:88b03b05-80d3-484f-8022-471f61604c8d-00038d7b", "Basic Wall : Retaining - 300mm Concrete": "e340d1fc-19c1-4200-9ff0-415bc126641d:1551350c-45e5-41b8-bdf1-bcfa6794dc6a-000adce2", "Basic Wall : SIP 202mm Wall - conc clad": "e340d1fc-19c1-4200-9ff0-415bc126641d:c85e5be0-d8d5-4148-836f-b55e711ef373-00068b9b", "Basic Wall : Wall - Timber Clad": "e340d1fc-19c1-4200-9ff0-415bc126641d:ef57b02a-5e81-49e7-93bb-ae5f002d921c-000306df", "Curtain Wall : SH_Curtain wall": "e340d1fc-19c1-4200-9ff0-415bc126641d:6cbabf1d-e8d0-47f0-ac4d-9a7923128d37-000700af"}, selected="Curtain Wall : SH_Curtain wall")

# ---- group: Vinduer, Døre og Glasfacader / Beregning af CO2 aftryk
cluster_3 = Cluster_3(T=element_type_picker_34, L=antal_elementer_der_tælles_med_i_query_e)  # -> E, R

# ---- group: Tage
# Type 7
exclude_27 = Exclude(
    C=categories_2,
    E=[element_type_picker_6, element_type_picker_11, element_type_picker_17, element_type_picker_23, element_type_picker_28, element_type_picker_33])
element_type_picker_35 = ElementTypePicker(
    exclude_27,
    {"Sloped Glazing : Sloped Glazing": "e340d1fc-19c1-4200-9ff0-415bc126641d:e3e052f9-0156-11d5-9301-0000863f27ad-00000152"}, selected=[])  # disabled

# ---- group: Dæk
# Type 7
exclude_28 = Exclude(
    C=categories_4,
    E=[element_type_picker_3, element_type_picker_9, element_type_picker_16, element_type_picker_22, element_type_picker_25, element_type_picker_32])
element_type_picker_36 = ElementTypePicker(
    exclude_28,
    {"Floor : Concrete-Domestic 425mm": "e340d1fc-19c1-4200-9ff0-415bc126641d:7f28cee1-b998-4a37-89e2-f58405cbbc56-0008df1d", "Floor : Generic 150mm": "e340d1fc-19c1-4200-9ff0-415bc126641d:e3e052f9-0156-11d5-9301-0000863f27ad-00000153", "Floor : Insitu Concrete 225mm": "e340d1fc-19c1-4200-9ff0-415bc126641d:7f28cee1-b998-4a37-89e2-f58405cbbc56-0008defb"}, selected=[])  # disabled

# ---- group: Terrændæk
# Type 7
exclude_29 = Exclude(
    C=categories_4,
    E=[element_type_picker_4, element_type_picker_7, element_type_picker_14, element_type_picker_21, element_type_picker_27, element_type_picker_31])
element_type_picker_37 = ElementTypePicker(
    exclude_29,
    {"Floor : Concrete-Domestic 425mm": "e340d1fc-19c1-4200-9ff0-415bc126641d:7f28cee1-b998-4a37-89e2-f58405cbbc56-0008df1d", "Floor : Generic 150mm": "e340d1fc-19c1-4200-9ff0-415bc126641d:e3e052f9-0156-11d5-9301-0000863f27ad-00000153", "Floor : Generic 300": "e340d1fc-19c1-4200-9ff0-415bc126641d:9c1f7993-9536-44bd-bedc-bf731228f65b-00072966", "Floor : Insitu Concrete 225mm": "e340d1fc-19c1-4200-9ff0-415bc126641d:7f28cee1-b998-4a37-89e2-f58405cbbc56-0008defb", "Floor : Timber Suspended Floor": "e340d1fc-19c1-4200-9ff0-415bc126641d:203cff26-4c9d-4eb4-93e5-28d28a01f256-0002d338"}, selected=[])  # disabled

# ---- group: Yder- & Indervægge
# Type 7
value_list_11 = ValueList({"Indervæg": False, "Ydervæg": True}, selected="Indervæg")  # disabled
exclude_30 = Exclude(
    C=categories,
    E=[element_type_picker_30, element_type_picker, element_type_picker_10, element_type_picker_15, element_type_picker_20, element_type_picker_26])
element_type_picker_38 = ElementTypePicker(
    exclude_30,
    {"Basic Wall : CL_W1": "e340d1fc-19c1-4200-9ff0-415bc126641d:e9d71ae9-50a0-4fd0-b533-dbc08decd09f-00092a3a", "Curtain Wall : SH_Curtain wall": "e340d1fc-19c1-4200-9ff0-415bc126641d:6cbabf1d-e8d0-47f0-ac4d-9a7923128d37-000700af"}, selected=[])  # disabled

# Type 8
value_list_12 = ValueList({"Indervæg": False, "Ydervæg": True}, selected="Ydervæg")  # disabled
exclude_31 = Exclude(
    C=categories,
    E=[element_type_picker_38, element_type_picker, element_type_picker_10, element_type_picker_15, element_type_picker_20, element_type_picker_26, element_type_picker_30])
element_type_picker_39 = ElementTypePicker(
    exclude_31,
    {"Basic Wall : CL_W1": "e340d1fc-19c1-4200-9ff0-415bc126641d:e9d71ae9-50a0-4fd0-b533-dbc08decd09f-00092a3a", "Curtain Wall : SH_Curtain wall": "e340d1fc-19c1-4200-9ff0-415bc126641d:6cbabf1d-e8d0-47f0-ac4d-9a7923128d37-000700af"}, selected=[])  # disabled

# ---- group: Tjek af overskydende elementer i modellen (elementer der ikke er beregnet med)
væg_konstruktioner = Cluster(
    E=elements.Elements,
    E_2=[element_type_picker_2, element_type_picker_12, element_type_picker_18, element_type_picker_24, element_type_picker, element_type_picker_10, element_type_picker_15, element_type_picker_20, element_type_picker_26, element_type_picker_30, element_type_picker_38, element_type_picker_39, element_type_picker_34])
overskydende_revit_elementer_yder_inderv = Panel(væg_konstruktioner)  # "Overskydende Revit elementer - Yder- & Indervægge, Glasfacader, Fundmaneter"

# ---- group: Dæk
exclude_32 = Exclude(
    C=categories_4,
    E=[element_type_picker_3, element_type_picker_9, element_type_picker_16, element_type_picker_22, element_type_picker_25, element_type_picker_32, element_type_picker_36])

# ---- group: Tage
# Type 8
exclude_33 = Exclude(
    C=categories_2,
    E=[element_type_picker_6, element_type_picker_11, element_type_picker_17, element_type_picker_23, element_type_picker_28, element_type_picker_33, element_type_picker_35])
element_type_picker_40 = ElementTypePicker(
    exclude_33,
    {"Sloped Glazing : Sloped Glazing": "e340d1fc-19c1-4200-9ff0-415bc126641d:e3e052f9-0156-11d5-9301-0000863f27ad-00000152"}, selected=[])  # disabled

# ---- group: Grafer / Grafer over samlede bygningsdele
overskrift = Panel("Udlending af samlede bygningsdele")

# ---- group: Terrændæk
# Type 8
exclude_34 = Exclude(
    C=categories_4,
    E=[element_type_picker_4, element_type_picker_7, element_type_picker_14, element_type_picker_21, element_type_picker_27, element_type_picker_31, element_type_picker_37])
element_type_picker_41 = ElementTypePicker(
    exclude_34,
    {"Floor : Concrete-Domestic 425mm": "e340d1fc-19c1-4200-9ff0-415bc126641d:7f28cee1-b998-4a37-89e2-f58405cbbc56-0008df1d", "Floor : Generic 150mm": "e340d1fc-19c1-4200-9ff0-415bc126641d:e3e052f9-0156-11d5-9301-0000863f27ad-00000153", "Floor : Generic 300": "e340d1fc-19c1-4200-9ff0-415bc126641d:9c1f7993-9536-44bd-bedc-bf731228f65b-00072966", "Floor : Insitu Concrete 225mm": "e340d1fc-19c1-4200-9ff0-415bc126641d:7f28cee1-b998-4a37-89e2-f58405cbbc56-0008defb", "Floor : Timber Suspended Floor": "e340d1fc-19c1-4200-9ff0-415bc126641d:203cff26-4c9d-4eb4-93e5-28d28a01f256-0002d338"}, selected=[])  # disabled

# ---- group: Dæk
# Type 8
element_type_picker_42 = ElementTypePicker(
    exclude_32,
    {"Floor : Concrete-Domestic 425mm": "e340d1fc-19c1-4200-9ff0-415bc126641d:7f28cee1-b998-4a37-89e2-f58405cbbc56-0008df1d", "Floor : Generic 150mm": "e340d1fc-19c1-4200-9ff0-415bc126641d:e3e052f9-0156-11d5-9301-0000863f27ad-00000153", "Floor : Insitu Concrete 225mm": "e340d1fc-19c1-4200-9ff0-415bc126641d:7f28cee1-b998-4a37-89e2-f58405cbbc56-0008defb"}, selected=[])  # disabled

# ---- group: Grafer / Grafer - Bygningsdele
entwine_2 = Entwine(
    Branch00=[type_1, multiplication_4],
    Branch01=[type_2, multiplication_5],
    Branch02=[type_3, multiplication_6],
    Branch03=[type_4, multiplication_7],
    FlattenInputs=True)
overskrift_2 = Panel("Yder- & Indervægge")
overskrift_3 = Panel("Tage og Lofter")
overskrift_4 = Panel("Dæk")
overskrift_5 = Panel("Terrændæk")
overskrift_6 = Panel("Fundament")
overskrift_7 = Panel("Vinduer, Døre, Glasfacader")
item_7 = ListItem(List=entwine_2, Index=0, Wrap=True)  # -> flatten(Item)
item_8 = ListItem(List=entwine_2, Index=Slider(1, range=0..1), Wrap=True)  # -> flatten(Item)
chart = CreateChart(
    ChartName=overskrift_6,
    ChartSeries="Fundament",
    ChartXAxisLabels=item_7,
    ValueTree=item_8,
    Chart_Theme="Bright Pastel",
    Chart_Type="Column")

# ---- group: Yder- & Indervægge / Beregning af CO2 aftryk
true_false_5 = Boolean(load_unload)
filsti_5 = FilePath(fill_sti)
true_false_6 = Boolean(load_unload)
filsti_6 = FilePath(fill_sti)
ydervægge = Ydervægge(read=true_false_5, path=filsti_5)  # -> gwp, bygningsdel
indervægge = Indervægge(read=true_false_6, path=filsti_6)  # -> gwp, bygningsdel
not_5 = GateNot(A=value_list)
not_6 = GateNot(A=value_list_6)
not_7 = GateNot(A=value_list_7)
not_8 = GateNot(A=value_list_8)
not_9 = GateNot(A=value_list_9)
not_10 = GateNot(A=value_list_10)
not_11 = GateNot(A=value_list_11)
not_12 = GateNot(A=value_list_11)
cluster_4 = Cluster(
    E=elements.Elements,
    E_2=[element_type_picker, element_type_picker_10, element_type_picker_15, element_type_picker_20, element_type_picker_26, element_type_picker_30, element_type_picker_38, element_type_picker_39])
onoff_9 = EnableDisableObject(Enabled=value_list, AllObjects_Object=[ydervægge_2, gwp_ydervæg, bygningsdel_ydervæg])
onoff_10 = EnableDisableObject(Enabled=not_5, AllObjects_Object=[bygningsdel_indervæg, gwp_indervæg, indervægge_2])
onoff_11 = EnableDisableObject(Enabled=value_list_6, AllObjects_Object=[gwp_ydervæg_2, bygningsdel_ydervæg_2, ydervægge_3])
onoff_12 = EnableDisableObject(Enabled=not_6, AllObjects_Object=[indervægge_3, bygningsdel_indervæg_2, gwp_indervæg_2])
onoff_13 = EnableDisableObject(Enabled=value_list_7, AllObjects_Object=[ydervægge_4, gwp_ydervæg_3, bygningsdel_ydervæg_3])
onoff_14 = EnableDisableObject(Enabled=not_7, AllObjects_Object=[bygningsdel_indervæg_3, gwp_indervæg_3, indervægge_4])
onoff_15 = EnableDisableObject(Enabled=value_list_8, AllObjects_Object=[ydervægge_5, gwp_ydervæg_4, bygningsdel_ydervæg_4])
onoff_16 = EnableDisableObject(Enabled=not_8, AllObjects_Object=[bygningsdel_indervæg_4, gwp_indervæg_4, indervægge_5])
onoff_17 = EnableDisableObject(Enabled=value_list_9, AllObjects_Object=[ydervægge_6, gwp_ydervæg_5, bygningsdel_ydervæg_5])
onoff_18 = EnableDisableObject(Enabled=not_9, AllObjects_Object=[indervægge_6, bygningsdel_indervæg_5, gwp_indervæg_5])
onoff_19 = EnableDisableObject(Enabled=value_list_10, AllObjects_Object=[ydervægge_7, gwp_ydervæg_6, bygningsdel_ydervæg_6])
onoff_20 = EnableDisableObject(Enabled=not_10, AllObjects_Object=[indervægge_7, bygningsdel_indervæg_6, gwp_indervæg_6])
onoff_21 = EnableDisableObject(Enabled=value_list_11, AllObjects_Object=[ydervæg, gwp_ydervæg_7, bygningsdel_ydervæg_7])
onoff_22 = EnableDisableObject(Enabled=not_11, AllObjects_Object=[bygningsdel_indervæg_7, gwp_indervæg_7, indervægge_8])
onoff_23 = EnableDisableObject(Enabled=value_list_11, AllObjects_Object=[ydervægge_8, gwp_ydervæg_8, bygningsdel_ydervæg_8])
onoff_24 = EnableDisableObject(Enabled=not_12, AllObjects_Object=[indervægge_9, bygningsdel_indervæg_8, gwp_indervæg_8])
type_1_7 = Type1(T=element_type_picker, L=antal_elementer_der_tælles_med_i_query_e)  # -> G, R
type_2_3 = Type1(T=element_type_picker_10, L=antal_elementer_der_tælles_med_i_query_e)  # -> G, R
type_3_3 = Type1(T=element_type_picker_15, L=antal_elementer_der_tælles_med_i_query_e)  # -> G, R
type_4_3 = Type1(T=element_type_picker_20, L=antal_elementer_der_tælles_med_i_query_e)  # -> G, R
type_5 = Type1(T=element_type_picker_26, L=antal_elementer_der_tælles_med_i_query_e)  # -> G, R
type_6 = Type1(T=element_type_picker_30, L=antal_elementer_der_tælles_med_i_query_e)  # -> G, R
type_7 = Type1(T=element_type_picker_38, L=antal_elementer_der_tælles_med_i_query_e)  # -> G, R
type_8 = Type1(T=element_type_picker_39, L=antal_elementer_der_tælles_med_i_query_e)  # -> G, R
bygningsdel_indervæg = Data(indervægge.bygningsdel)
bygningsdel_indervæg_2 = Data(indervægge.bygningsdel)  # disabled
bygningsdel_indervæg_3 = Data(indervægge.bygningsdel)  # disabled
bygningsdel_indervæg_4 = Data(indervægge.bygningsdel)  # disabled
bygningsdel_indervæg_5 = Data(indervægge.bygningsdel)  # disabled
bygningsdel_indervæg_6 = Data(indervægge.bygningsdel)
bygningsdel_ydervæg = Data(ydervægge.bygningsdel)  # disabled
bygningsdel_indervæg_7 = Data(indervægge.bygningsdel)
bygningsdel_ydervæg_2 = Data(ydervægge.bygningsdel)
bygningsdel_ydervæg_3 = Data(ydervægge.bygningsdel)
bygningsdel_ydervæg_4 = Data(ydervægge.bygningsdel)
bygningsdel_indervæg_8 = Data(indervægge.bygningsdel)
bygningsdel_ydervæg_5 = Data(ydervægge.bygningsdel)
bygningsdel_ydervæg_6 = Data(ydervægge.bygningsdel)  # disabled
bygningsdel_ydervæg_7 = Data(ydervægge.bygningsdel)  # disabled
bygningsdel_ydervæg_8 = Data(ydervægge.bygningsdel)  # disabled
gwp_indervæg = Data(indervægge.gwp)
gwp_indervæg_2 = Data(indervægge.gwp)  # disabled
gwp_indervæg_3 = Data(indervægge.gwp)  # disabled
gwp_indervæg_4 = Data(indervægge.gwp)  # disabled
gwp_indervæg_5 = Data(indervægge.gwp)  # disabled
gwp_indervæg_6 = Data(indervægge.gwp)
gwp_ydervæg = Data(ydervægge.gwp)  # disabled
gwp_ydervæg_2 = Data(ydervægge.gwp)
gwp_indervæg_7 = Data(indervægge.gwp)
overskydende_revit_elementer_2 = Panel(cluster_4)
gwp_ydervæg_3 = Data(ydervægge.gwp)
gwp_ydervæg_4 = Data(ydervægge.gwp)
gwp_indervæg_8 = Data(indervægge.gwp)
gwp_ydervæg_5 = Data(ydervægge.gwp)
gwp_ydervæg_6 = Data(ydervægge.gwp)  # disabled
gwp_ydervæg_7 = Data(ydervægge.gwp)  # disabled
gwp_ydervæg_8 = Data(ydervægge.gwp)  # disabled
geo_9 = Geometry(type_1_7.G)
areal = Number(type_1_7.R)
geo_10 = Geometry(type_2_3.G)
areal_2 = Number(type_2_3.R)
geo_11 = Geometry(type_3_3.G)
areal_3 = Number(type_3_3.R)
geo_12 = Geometry(type_4_3.G)
areal_4 = Number(type_4_3.R)
areal_5 = Number(type_5.R)
geo_13 = Geometry(type_5.G)
areal_6 = Number(type_6.R)
geo_14 = Geometry(type_6.G)
areal_7 = Number(type_7.R)
areal_8 = Number(type_8.R)
geo_15 = Geometry(type_7.G)
geo_16 = Geometry(type_8.G)

# ---- group: Yder- & Indervægge (continued)
ydervægge_2 = ItemSelector(
    ydervægge.bygningsdel,
    {"21 / Gen. / Beton 150 mm. / Alupaneler": "21 / Gen. / Beton 150 mm. / Alupaneler ", "21 / Gen. / Beton 150 mm. / Nåletræ", "21 / Gen. / Beton 150 mm. / Skærmtegl Alu ophæng", "21 / Gen. / Beton 150 mm. / Skærmtegl Træ ophæng", "21 / Gen. / Beton 150 mm. / Traditionel Teglsten", "21 / Gen. / Beton 150 mm. / Zink, Stående Fals", "21 / Gen. / CLT 150 mm. / Nåletræ", "21 / Gen. / CLT 150 mm. / Skærmtegl Træ ophæng", "21 / Gen. / Stål / Alupaneler", "21 / Gen. / Stål / Nåletræ"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}, selected="21 / Gen. / Stål / Nåletræ")  # disabled
indervægge_2 = ItemSelector(
    indervægge.bygningsdel,
    {"22 / Gen. / Beton 150 mm. / Bærende / Maling", "22 / Gen. / CLT 150 mm. / Bærende": "22 / Gen. / CLT 150 mm. / Bærende ", "22 / Gen. / Letbeton 150 mm. / Bærende / Maling", "22 / Gen. / Træ / Bærende / Gips 2 Lags", "22 / Gen. / CLT 80 mm. / Ikke bærende", "22 / Gen. / Stål / Ikke Bærende / Gips 2 Lags", "22 / Gen. / Træ / Ikke Bærende / Gips 2 Lags", "22 / Gen. / Træ / Ikke Bærende / Krydsfiner"}, selected="22 / Gen. / Træ / Ikke Bærende / Gips 2 Lags")
geo_17 = Geometry(geo_9)
preview_5 = CustomPreview(Geometry=geo_17, Material=ColourSwatch(SwatchColor=RGB(0, 170, 255)))

ydervægge_3 = ItemSelector(
    ydervægge.bygningsdel,
    {"21 / Gen. / Beton 150 mm. / Traditionel Teglsten", "21 / Prod. / Beton 150 mm. / Genbrug Teglsten", "21 / Prod. / Beton 150 mm. / Røde Less Teglsten", "21 / Prod. / Beton 150 mm. / Thermowood Sature", "21 / Prod. / CLT 150 mm. / Thermowood Sature", "21 / Prod. / Stål / Thermowood Sature", "21 / Prod. / Træ / Thermowood Sature"}, selected="21 / Prod. / Træ / Thermowood Sature")
indervægge_3 = ItemSelector(
    indervægge.bygningsdel,
    {"22 / Gen. / Beton 150 mm. / Bærende / Kalk puds", "22 / Gen. / Beton 150 mm. / Bærende / Ler puds", "22 / Gen. / Beton 150 mm. / Bærende / Maling", "22 / Gen. / CLT 150 mm. / Bærende": "22 / Gen. / CLT 150 mm. / Bærende ", "22 / Gen. / CLT 150 mm. / Bærende / Kalk puds", "22 / Gen. / CLT 150 mm. / Bærende / Ler puds", "22 / Gen. / Letbeton 150 mm. / Bærende / Kalk puds", "22 / Gen. / Letbeton 150 mm. / Bærende / Maling", "22 / Gen. / Porebeton 100 mm. / Bærende / Kalk puds", "22 / Gen. / Porebeton 100 mm. / Bærende / Maling"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}, selected="22 / Gen. / Træ / Bærende / Gips 2 Lags")  # disabled
geo_18 = Geometry(geo_10)
preview_6 = CustomPreview(Geometry=geo_18, Material=ColourSwatch(SwatchColor=RGB(0, 153, 230)))

ydervægge_4 = ItemSelector(
    ydervægge.bygningsdel,
    {"21 / Gen. / Beton 150 mm. / Traditionel Teglsten", "21 / Prod. / Beton 150 mm. / Genbrug Teglsten", "21 / Prod. / Beton 150 mm. / Røde Less Teglsten", "21 / Prod. / Beton 150 mm. / Thermowood Sature", "21 / Prod. / CLT 150 mm. / Thermowood Sature", "21 / Prod. / Stål / Thermowood Sature", "21 / Prod. / Træ / Thermowood Sature"}, selected="21 / Gen. / Beton 150 mm. / Traditionel Teglsten")  # disabled
indervægge_4 = ItemSelector(
    indervægge.bygningsdel,
    {"22 / Gen. / Beton 150 mm. / Bærende / Kalk puds", "22 / Gen. / Beton 150 mm. / Bærende / Ler puds", "22 / Gen. / Beton 150 mm. / Bærende / Maling", "22 / Gen. / CLT 150 mm. / Bærende": "22 / Gen. / CLT 150 mm. / Bærende ", "22 / Gen. / CLT 150 mm. / Bærende / Kalk puds", "22 / Gen. / CLT 150 mm. / Bærende / Ler puds", "22 / Gen. / Letbeton 150 mm. / Bærende / Kalk puds", "22 / Gen. / Letbeton 150 mm. / Bærende / Maling", "22 / Gen. / Porebeton 100 mm. / Bærende / Kalk puds", "22 / Gen. / Porebeton 100 mm. / Bærende / Maling"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}, selected="22 / Gen. / Træ / Bærende / Gips 2 Lags")  # disabled
geo_19 = Geometry(geo_11)
preview_7 = CustomPreview(Geometry=geo_19, Material=ColourSwatch(SwatchColor=RGB(0, 136, 204)))

ydervægge_5 = ItemSelector(
    ydervægge.bygningsdel,
    {"21 / Gen. / Beton 150 mm. / Alupaneler": "21 / Gen. / Beton 150 mm. / Alupaneler ", "21 / Gen. / Beton 150 mm. / Nåletræ", "21 / Gen. / Beton 150 mm. / Skærmtegl Alu ophæng", "21 / Gen. / Beton 150 mm. / Skærmtegl Træ ophæng", "21 / Gen. / Beton 150 mm. / Traditionel Teglsten", "21 / Gen. / Beton 150 mm. / Zink, Stående Fals", "21 / Gen. / CLT 150 mm. / Nåletræ", "21 / Gen. / CLT 150 mm. / Skærmtegl Træ ophæng", "21 / Gen. / Stål / Alupaneler", "21 / Gen. / Stål / Nåletræ"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}, selected="21 / Gen. / Træ / Skærmtegl Træ ophæng")  # disabled
indervægge_5 = ItemSelector(
    indervægge.bygningsdel,
    {"22 / Gen. / Beton 150 mm. / Bærende / Kalk puds", "22 / Gen. / Beton 150 mm. / Bærende / Ler puds", "22 / Gen. / Beton 150 mm. / Bærende / Maling", "22 / Gen. / CLT 150 mm. / Bærende": "22 / Gen. / CLT 150 mm. / Bærende ", "22 / Gen. / CLT 150 mm. / Bærende / Kalk puds", "22 / Gen. / CLT 150 mm. / Bærende / Ler puds", "22 / Gen. / Letbeton 150 mm. / Bærende / Kalk puds", "22 / Gen. / Letbeton 150 mm. / Bærende / Maling", "22 / Gen. / Porebeton 100 mm. / Bærende / Kalk puds", "22 / Gen. / Porebeton 100 mm. / Bærende / Maling"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}, selected="22 / Gen. / Stål / Ikke Bærende / Brandgips 2 lags")  # disabled
geo_20 = Geometry(geo_12)
preview_8 = CustomPreview(Geometry=geo_20, Material=ColourSwatch(SwatchColor=RGB(0, 119, 178)))

ydervægge_6 = ItemSelector(
    ydervægge.bygningsdel,
    {"21 / Gen. / Beton 150 mm. / Alupaneler": "21 / Gen. / Beton 150 mm. / Alupaneler ", "21 / Gen. / Beton 150 mm. / Nåletræ", "21 / Gen. / Beton 150 mm. / Skærmtegl Alu ophæng", "21 / Gen. / Beton 150 mm. / Skærmtegl Træ ophæng", "21 / Gen. / Beton 150 mm. / Traditionel Teglsten", "21 / Gen. / Beton 150 mm. / Zink, Stående Fals", "21 / Gen. / CLT 150 mm. / Nåletræ", "21 / Gen. / CLT 150 mm. / Skærmtegl Træ ophæng", "21 / Gen. / Stål / Alupaneler", "21 / Gen. / Stål / Nåletræ"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}, selected="21 / Gen. / Beton 150 mm. / Alupaneler")  # disabled
indervægge_6 = ItemSelector(
    indervægge.bygningsdel,
    {"22 / Gen. / Beton 150 mm. / Bærende / Kalk puds", "22 / Gen. / Beton 150 mm. / Bærende / Ler puds", "22 / Gen. / Beton 150 mm. / Bærende / Maling", "22 / Gen. / CLT 150 mm. / Bærende": "22 / Gen. / CLT 150 mm. / Bærende ", "22 / Gen. / CLT 150 mm. / Bærende / Kalk puds", "22 / Gen. / CLT 150 mm. / Bærende / Ler puds", "22 / Gen. / Letbeton 150 mm. / Bærende / Kalk puds", "22 / Gen. / Letbeton 150 mm. / Bærende / Maling", "22 / Gen. / Porebeton 100 mm. / Bærende / Kalk puds", "22 / Gen. / Porebeton 100 mm. / Bærende / Maling"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}, selected="22 / Gen. / Stål / Ikke Bærende / Brandgips 2 lags")  # disabled
geo_21 = Geometry(geo_13)
preview_9 = CustomPreview(Geometry=geo_21, Material=ColourSwatch(SwatchColor=RGB(0, 102, 153)))

ydervægge_7 = ItemSelector(
    ydervægge.bygningsdel,
    {"21 / Gen. / Beton 150 mm. / Alupaneler": "21 / Gen. / Beton 150 mm. / Alupaneler ", "21 / Gen. / Beton 150 mm. / Nåletræ", "21 / Gen. / Beton 150 mm. / Skærmtegl Alu ophæng", "21 / Gen. / Beton 150 mm. / Skærmtegl Træ ophæng", "21 / Gen. / Beton 150 mm. / Traditionel Teglsten", "21 / Gen. / Beton 150 mm. / Zink, Stående Fals", "21 / Gen. / CLT 150 mm. / Nåletræ", "21 / Gen. / CLT 150 mm. / Skærmtegl Træ ophæng", "21 / Gen. / Stål / Alupaneler", "21 / Gen. / Stål / Nåletræ"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}, selected="21 / Gen. / Beton 150 mm. / Alupaneler")  # disabled
indervægge_7 = ItemSelector(
    indervægge.bygningsdel,
    {"22 / Gen. / Beton 150 mm. / Bærende / Kalk puds", "22 / Gen. / Beton 150 mm. / Bærende / Ler puds", "22 / Gen. / Beton 150 mm. / Bærende / Maling", "22 / Gen. / CLT 150 mm. / Bærende": "22 / Gen. / CLT 150 mm. / Bærende ", "22 / Gen. / CLT 150 mm. / Bærende / Kalk puds", "22 / Gen. / CLT 150 mm. / Bærende / Ler puds", "22 / Gen. / Letbeton 150 mm. / Bærende / Kalk puds", "22 / Gen. / Letbeton 150 mm. / Bærende / Maling", "22 / Gen. / Porebeton 100 mm. / Bærende / Kalk puds", "22 / Gen. / Porebeton 100 mm. / Bærende / Maling"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}, selected="22 / Gen. / Beton 150 mm. / Bærende / Kalk puds")  # disabled
geo_22 = Geometry(geo_14)
preview_10 = CustomPreview(Geometry=geo_22, Material=ColourSwatch(SwatchColor=RGB(0, 85, 128)))

ydervæg = ItemSelector(
    ydervægge.bygningsdel,
    {"21 / Gen. / Beton 150 mm. / Alupaneler": "21 / Gen. / Beton 150 mm. / Alupaneler ", "21 / Gen. / Beton 150 mm. / Nåletræ", "21 / Gen. / Beton 150 mm. / Skærmtegl Alu ophæng", "21 / Gen. / Beton 150 mm. / Skærmtegl Træ ophæng", "21 / Gen. / Beton 150 mm. / Traditionel Teglsten", "21 / Gen. / Beton 150 mm. / Zink, Stående Fals", "21 / Gen. / CLT 150 mm. / Nåletræ", "21 / Gen. / CLT 150 mm. / Skærmtegl Træ ophæng", "21 / Gen. / Stål / Alupaneler", "21 / Gen. / Stål / Nåletræ"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}, selected="21 / Gen. / Beton 150 mm. / Alupaneler")  # disabled
indervægge_8 = ItemSelector(
    indervægge.bygningsdel,
    {"22 / Gen. / Beton 150 mm. / Bærende / Kalk puds", "22 / Gen. / Beton 150 mm. / Bærende / Ler puds", "22 / Gen. / Beton 150 mm. / Bærende / Maling", "22 / Gen. / CLT 150 mm. / Bærende": "22 / Gen. / CLT 150 mm. / Bærende ", "22 / Gen. / CLT 150 mm. / Bærende / Kalk puds", "22 / Gen. / CLT 150 mm. / Bærende / Ler puds", "22 / Gen. / Letbeton 150 mm. / Bærende / Kalk puds", "22 / Gen. / Letbeton 150 mm. / Bærende / Maling", "22 / Gen. / Porebeton 100 mm. / Bærende / Kalk puds", "22 / Gen. / Porebeton 100 mm. / Bærende / Maling"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}, selected="22 / Gen. / Beton 150 mm. / Bærende / Kalk puds")  # disabled
geo_23 = Geometry(geo_15)
preview_11 = CustomPreview(Geometry=geo_23, Material=ColourSwatch(SwatchColor=RGB(0, 68, 102)))

ydervægge_8 = ItemSelector(
    ydervægge.bygningsdel,
    {"21 / Gen. / Beton 150 mm. / Alupaneler": "21 / Gen. / Beton 150 mm. / Alupaneler ", "21 / Gen. / Beton 150 mm. / Nåletræ", "21 / Gen. / Beton 150 mm. / Skærmtegl Alu ophæng", "21 / Gen. / Beton 150 mm. / Skærmtegl Træ ophæng", "21 / Gen. / Beton 150 mm. / Traditionel Teglsten", "21 / Gen. / Beton 150 mm. / Zink, Stående Fals", "21 / Gen. / CLT 150 mm. / Nåletræ", "21 / Gen. / CLT 150 mm. / Skærmtegl Træ ophæng", "21 / Gen. / Stål / Alupaneler", "21 / Gen. / Stål / Nåletræ"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}, selected="21 / Gen. / Beton 150 mm. / Alupaneler")  # disabled
indervægge_9 = ItemSelector(
    indervægge.bygningsdel,
    {"22 / Gen. / Beton 150 mm. / Bærende / Kalk puds", "22 / Gen. / Beton 150 mm. / Bærende / Ler puds", "22 / Gen. / Beton 150 mm. / Bærende / Maling", "22 / Gen. / CLT 150 mm. / Bærende": "22 / Gen. / CLT 150 mm. / Bærende ", "22 / Gen. / CLT 150 mm. / Bærende / Kalk puds", "22 / Gen. / CLT 150 mm. / Bærende / Ler puds", "22 / Gen. / Letbeton 150 mm. / Bærende / Kalk puds", "22 / Gen. / Letbeton 150 mm. / Bærende / Maling", "22 / Gen. / Porebeton 100 mm. / Bærende / Kalk puds", "22 / Gen. / Porebeton 100 mm. / Bærende / Maling"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}, selected="22 / Gen. / Beton 150 mm. / Bærende / Kalk puds")  # disabled
geo_24 = Geometry(geo_16)
preview_12 = CustomPreview(Geometry=geo_24, Material=ColourSwatch(SwatchColor=RGB(0, 51, 76)))

# ---- group: Yder- & Indervægge / Beregning af CO2 aftryk (continued)
gwp_5 = GWP(L=[gwp_ydervæg, gwp_indervæg], S=[ydervægge_2, indervægge_2], M=[bygningsdel_ydervæg, bygningsdel_indervæg])
gwp_6 = GWP(L=[gwp_ydervæg_2, gwp_indervæg_2], S=[indervægge_3, ydervægge_3], M=[bygningsdel_ydervæg_2, bygningsdel_indervæg_2])
gwp_7 = GWP(L=[gwp_ydervæg_3, gwp_indervæg_3], S=[ydervægge_4, indervægge_4], M=[bygningsdel_ydervæg_3, bygningsdel_indervæg_3])
gwp_8 = GWP(L=[gwp_ydervæg_4, gwp_indervæg_4], S=[ydervægge_5, indervægge_5], M=[bygningsdel_ydervæg_4, bygningsdel_indervæg_4])
gwp_9 = GWP(L=[gwp_ydervæg_5, gwp_indervæg_5], S=[ydervægge_6, indervægge_6], M=[bygningsdel_ydervæg_5, bygningsdel_indervæg_5])
gwp_10 = GWP(L=[gwp_ydervæg_6, gwp_indervæg_6], S=[ydervægge_7, indervægge_7], M=[bygningsdel_ydervæg_6, bygningsdel_indervæg_6])
gwp_11 = GWP(L=[gwp_ydervæg_7, gwp_indervæg_7], S=[ydervæg, indervægge_8], M=[bygningsdel_ydervæg_7, bygningsdel_indervæg_7])
gwp_12 = GWP(L=[gwp_ydervæg_8, gwp_indervæg_8], S=[ydervægge_8, indervægge_9], M=[bygningsdel_ydervæg_8, bygningsdel_indervæg_8])
multiplication_8 = Multiplication(A=gwp_5, B=areal)
multiplication_9 = Multiplication(A=gwp_6, B=areal_2)
multiplication_10 = Multiplication(A=gwp_7, B=areal_3)
multiplication_11 = Multiplication(A=gwp_8, B=areal_4)
multiplication_12 = Multiplication(A=gwp_9, B=areal_5)
multiplication_13 = Multiplication(A=gwp_10, B=areal_6)
multiplication_14 = Multiplication(A=gwp_11, B=areal_7)
multiplication_15 = Multiplication(A=gwp_12, B=areal_8)
gwp_type_1_1m2_5 = Panel(gwp_5)
gwp_type_2_1m2 = Panel(gwp_6)
gwp_type_3_1m2 = Panel(gwp_7)
gwp_type_4_1m2 = Panel(gwp_8)
gwp_type_5_1m2 = Panel(gwp_9)
gwp_type_6_1m2 = Panel(gwp_10)
gwp_type_7_1m2 = Panel(gwp_11)
gwp_type_8_1m2 = Panel(gwp_12)
type_1_8 = Type8(gwp=multiplication_8, antal=areal)  # -> gwp_2, antal_2
type_2_4 = Type8(gwp=multiplication_9, antal=areal_2)  # -> gwp_2, antal_2
type_3_4 = Type8(gwp=multiplication_10, antal=areal_3)  # -> gwp_2, antal_2
type_4_4 = Type8(gwp=multiplication_11, antal=areal_4)  # -> gwp_2, antal_2
type_5_2 = Type8(gwp=multiplication_12, antal=areal_5)  # -> gwp_2, antal_2
type_6_2 = Type8(gwp=multiplication_13, antal=areal_6)  # -> gwp_2, antal_2
type_7_2 = Type8(gwp=multiplication_14, antal=areal_7)  # -> gwp_2, antal_2
type_8_2 = Type8(gwp=multiplication_15, antal=areal_8)  # -> gwp_2, antal_2
addition_3 = Addition(
    Type1=multiplication_8,
    Type2=multiplication_9,
    Type3=multiplication_10,
    Type4=multiplication_11,
    Type5=multiplication_12,
    Type6=multiplication_13,
    Type7=multiplication_14,
    Type8=multiplication_15)
entwine_3 = Entwine(
    Branch00=[ydervægge_2, indervægge_2, type_1_8.gwp_2, type_1_8.antal_2],
    Branch01=[ydervægge_3, indervægge_3, type_2_4.gwp_2, type_2_4.antal_2],
    Branch02=[ydervægge_4, indervægge_4, type_3_4.gwp_2, type_3_4.antal_2],
    Branch03=[ydervægge_5, indervægge_5, type_4_4.gwp_2, type_4_4.antal_2],
    Branch04=[ydervægge_6, indervægge_6, type_5_2.gwp_2, type_5_2.antal_2],
    Branch05=[ydervægge_7, indervægge_7, type_6_2.gwp_2, type_6_2.antal_2],
    Branch06=[ydervæg, indervægge_8, type_7_2.gwp_2, type_7_2.antal_2],
    Branch07=[ydervægge_8, indervægge_9, type_8_2.gwp_2, type_8_2.antal_2],
    FlattenInputs=True)
samlet_co2_eq_for_ydervægge_og_indervægg = Panel(addition_3)  # "Samlet CO2-eq. for Ydervægge og Indervægge"
samlet_co2_eq_pr_bygningsdel_2 = Panel(entwine_3)

# ---- group: Resultat / Udregning af resultat (continued)
num_9 = Number(addition_3)

# ---- group: Resultat / Analyse af resultat (continued)
bygningsdele_2 = Data([ydervægge_2, indervægge_2, ydervægge_3, indervægge_3, ydervægge_4, indervægge_4, ydervægge_5, indervægge_5, ydervægge_6, indervægge_6, ydervægge_7, indervægge_7, ydervæg, indervægge_8, ydervægge_8, indervægge_9])

# ---- group: Grafer / Grafer - Bygningsdele (continued)
entwine_4 = Entwine(
    Branch00=[ydervægge_2, indervægge_2, multiplication_8],
    Branch01=[ydervægge_3, indervægge_3, multiplication_9],
    Branch02=[ydervægge_4, indervægge_4, multiplication_10],
    Branch03=[ydervægge_5, indervægge_5, multiplication_11],
    Branch04=[ydervægge_6, indervægge_6, multiplication_12],
    Branch05=[ydervægge_7, indervægge_7, multiplication_13],
    Branch06=[ydervæg, indervægge_8, multiplication_14],
    Branch07=[ydervægge_8, indervægge_9, multiplication_15],
    FlattenInputs=True)
item_9 = ListItem(List=entwine_4, Index=0, Wrap=True)  # -> flatten(Item)
item_10 = ListItem(List=entwine_4, Index=Slider(1, range=0..1), Wrap=True)  # -> flatten(Item)
chart_2 = CreateChart(
    ChartName=overskrift_2,
    ChartSeries="Ydervægge",
    ChartXAxisLabels=item_9,
    ValueTree=item_10,
    Chart_Theme="Bright Pastel",
    Chart_Type="Column")

# ---- group: Dæk / Beregning af CO2 aftryk
true_false_7 = Boolean(load_unload)
filsti_7 = FilePath(fill_sti)
dæk_2 = Dæk(read=true_false_7, path=filsti_7)  # -> gwp, bygningsdel
type_1_9 = Type1(T=element_type_picker_3, L=antal_elementer_der_tælles_med_i_query_e)  # -> G, R
type_2_5 = Type1(T=element_type_picker_9, L=antal_elementer_der_tælles_med_i_query_e)  # -> G, R
type_3_5 = Type1(T=element_type_picker_16, L=antal_elementer_der_tælles_med_i_query_e)  # -> G, R
type_4_5 = Type1(T=element_type_picker_22, L=antal_elementer_der_tælles_med_i_query_e)  # -> G, R
type_5_3 = Type1(T=element_type_picker_25, L=antal_elementer_der_tælles_med_i_query_e)  # -> G, R
type_6_3 = Type1(T=element_type_picker_32, L=antal_elementer_der_tælles_med_i_query_e)  # -> G, R
type_7_3 = Type1(T=element_type_picker_36, L=antal_elementer_der_tælles_med_i_query_e)  # -> G, R
type_7_4 = Type1(T=element_type_picker_42, L=antal_elementer_der_tælles_med_i_query_e)  # -> G, R
cluster_5 = Cluster(
    E=elements_4.Elements,
    E_2=[element_type_picker_3, element_type_picker_9, element_type_picker_16, element_type_picker_22, element_type_picker_25, element_type_picker_32, element_type_picker_36, element_type_picker_42])
geo_25 = Geometry(type_7_3.G)
geo_26 = Geometry(type_1_9.G)
num_10 = Number(type_1_9.R)
num_11 = Number(type_2_5.R)
num_12 = Number(type_3_5.R)
geo_27 = Geometry(type_4_5.G)
num_13 = Number(type_4_5.R)
num_14 = Number(type_5_3.R)
geo_28 = Geometry(type_6_3.G)
num_15 = Number(type_6_3.R)
num_16 = Number(type_7_3.R)
geo_29 = Geometry(type_7_4.G)
num_17 = Number(type_7_4.R)
geo_30 = Geometry(type_2_5.G)
geo_31 = Geometry(type_3_5.G)
geo_32 = Geometry(type_5_3.G)
overskydende_revit_elementer_3 = Panel(cluster_5)

# ---- group: Dæk (continued)
geo_33 = Geometry(geo_26)
geo_34 = Geometry(geo_29)

type_1_10 = ItemSelector(
    dæk_2.bygningsdel,
    {"23 / Gen. / Beton Huldæk / Maling, Trægulv strøer", "23 / Gen. / Beton Huldæk / Træbeton, Trægulv strøer", "23 / Gen. / CLT / Nedhængt, Trægulv strøer", "23 / Gen. / CLT / Træbeton, Trægulv strøer", "23 / Gen. / Hybrid / Maling, Trægulv svømmende", "23 / Gen. / Hybrid / Nedhængt, Trægulv strøer", "23 / Gen. / Stål / Maling, Trægulv strøer", "23 / Gen. / Stål / Træbeton, Trægulv strøer", "23 / Gen. / Træelement / Nedhængt, Trægulv strøer", "23 / Gen. / Træelement / Træbeton, Trægulv strøer"}, selected="23 / Gen. / Træelement / Træbeton, Trægulv strøer")
preview_13 = CustomPreview(Geometry=geo_33, Material=ColourSwatch(SwatchColor=RGB(255, 0, 255)))

type_2_6 = ItemSelector(
    dæk_2.bygningsdel,
    {"23 / Gen. / Beton Huldæk / Maling, Betonslidlag", "23 / Gen. / Beton Huldæk / Maling, Klinker", "23 / Gen. / Beton Huldæk / Maling, Linoleum", "23 / Gen. / Beton Huldæk / Maling, Parket svømmende", "23 / Gen. / Beton Huldæk / Maling, Trægulv strøer", "23 / Gen. / Beton Huldæk / Maling, Vinyl"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}, selected="23 / Gen. / Beton Huldæk / Maling, Betonslidlag")  # disabled
geo_35 = Geometry(geo_30)
preview_14 = CustomPreview(Geometry=geo_35, Material=ColourSwatch(SwatchColor=RGB(230, 0, 230)))

type_3_6 = ItemSelector(
    dæk_2.bygningsdel,
    {"23 / Gen. / Beton Huldæk / Maling, Betonslidlag", "23 / Gen. / Beton Huldæk / Maling, Klinker", "23 / Gen. / Beton Huldæk / Maling, Linoleum", "23 / Gen. / Beton Huldæk / Maling, Parket svømmende", "23 / Gen. / Beton Huldæk / Maling, Trægulv strøer", "23 / Gen. / Beton Huldæk / Maling, Vinyl"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}, selected="23 / Gen. / Beton Huldæk / Maling, Betonslidlag")  # disabled
geo_36 = Geometry(geo_31)
preview_15 = CustomPreview(Geometry=geo_36, Material=ColourSwatch(SwatchColor=RGB(204, 0, 204)))

type_4_6 = ItemSelector(
    dæk_2.bygningsdel,
    {"23 / Gen. / Beton Huldæk / Maling, Betonslidlag", "23 / Gen. / Beton Huldæk / Maling, Klinker", "23 / Gen. / Beton Huldæk / Maling, Linoleum", "23 / Gen. / Beton Huldæk / Maling, Parket svømmende", "23 / Gen. / Beton Huldæk / Maling, Trægulv strøer", "23 / Gen. / Beton Huldæk / Maling, Vinyl"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}, selected="23 / Gen. / Beton Huldæk / Maling, Betonslidlag")  # disabled
geo_37 = Geometry(geo_27)
preview_16 = CustomPreview(Geometry=geo_37, Material=ColourSwatch(SwatchColor=RGB(178, 0, 178)))

type_5_4 = ItemSelector(
    dæk_2.bygningsdel,
    {"21 / Gen. / Beton 150 mm. / Alupaneler": "21 / Gen. / Beton 150 mm. / Alupaneler ", "21 / Gen. / Beton 150 mm. / Nåletræ", "21 / Gen. / Beton 150 mm. / Skærmtegl Alu ophæng", "21 / Gen. / Beton 150 mm. / Skærmtegl Træ ophæng", "21 / Gen. / Beton 150 mm. / Traditionel Teglsten", "21 / Gen. / Beton 150 mm. / Zink, Stående Fals", "21 / Gen. / CLT 150 mm. / Nåletræ", "21 / Gen. / CLT 150 mm. / Skærmtegl Træ ophæng", "21 / Gen. / Stål / Alupaneler", "21 / Gen. / Stål / Nåletræ"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}, selected="21 / Gen. / Beton 150 mm. / Alupaneler")  # disabled
geo_38 = Geometry(geo_32)
preview_17 = CustomPreview(Geometry=geo_38, Material=ColourSwatch(SwatchColor=RGB(153, 0, 153)))

type_6_4 = ItemSelector(
    dæk_2.bygningsdel,
    {"21 / Gen. / Beton 150 mm. / Alupaneler": "21 / Gen. / Beton 150 mm. / Alupaneler ", "21 / Gen. / Beton 150 mm. / Nåletræ", "21 / Gen. / Beton 150 mm. / Skærmtegl Alu ophæng", "21 / Gen. / Beton 150 mm. / Skærmtegl Træ ophæng", "21 / Gen. / Beton 150 mm. / Traditionel Teglsten", "21 / Gen. / Beton 150 mm. / Zink, Stående Fals", "21 / Gen. / CLT 150 mm. / Nåletræ", "21 / Gen. / CLT 150 mm. / Skærmtegl Træ ophæng", "21 / Gen. / Stål / Alupaneler", "21 / Gen. / Stål / Nåletræ"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}, selected="21 / Gen. / Beton 150 mm. / Alupaneler")  # disabled
geo_39 = Geometry(geo_28)
preview_18 = CustomPreview(Geometry=geo_39, Material=ColourSwatch(SwatchColor=RGB(128, 0, 128)))

type_7_5 = ItemSelector(
    dæk_2.bygningsdel,
    {"21 / Gen. / Beton 150 mm. / Alupaneler": "21 / Gen. / Beton 150 mm. / Alupaneler ", "21 / Gen. / Beton 150 mm. / Nåletræ", "21 / Gen. / Beton 150 mm. / Skærmtegl Alu ophæng", "21 / Gen. / Beton 150 mm. / Skærmtegl Træ ophæng", "21 / Gen. / Beton 150 mm. / Traditionel Teglsten", "21 / Gen. / Beton 150 mm. / Zink, Stående Fals", "21 / Gen. / CLT 150 mm. / Nåletræ", "21 / Gen. / CLT 150 mm. / Skærmtegl Træ ophæng", "21 / Gen. / Stål / Alupaneler", "21 / Gen. / Stål / Nåletræ"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}, selected="21 / Gen. / Beton 150 mm. / Alupaneler")  # disabled
geo_40 = Geometry(geo_25)
preview_19 = CustomPreview(Geometry=geo_40, Material=ColourSwatch(SwatchColor=RGB(102, 0, 102)))

type_8_3 = ItemSelector(
    dæk_2.bygningsdel,
    {"21 / Gen. / Beton 150 mm. / Alupaneler": "21 / Gen. / Beton 150 mm. / Alupaneler ", "21 / Gen. / Beton 150 mm. / Nåletræ", "21 / Gen. / Beton 150 mm. / Skærmtegl Alu ophæng", "21 / Gen. / Beton 150 mm. / Skærmtegl Træ ophæng", "21 / Gen. / Beton 150 mm. / Traditionel Teglsten", "21 / Gen. / Beton 150 mm. / Zink, Stående Fals", "21 / Gen. / CLT 150 mm. / Nåletræ", "21 / Gen. / CLT 150 mm. / Skærmtegl Træ ophæng", "21 / Gen. / Stål / Alupaneler", "21 / Gen. / Stål / Nåletræ"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}, selected="21 / Gen. / Beton 150 mm. / Alupaneler")  # disabled
preview_20 = CustomPreview(Geometry=geo_34, Material=ColourSwatch(SwatchColor=RGB(76, 0, 76)))

# ---- group: Dæk / Beregning af CO2 aftryk (continued)
gwp_13 = GWP(L=dæk_2.gwp, S=type_1_10, M=dæk_2.bygningsdel)
gwp_14 = GWP(L=dæk_2.gwp, S=type_2_6, M=dæk_2.bygningsdel)
gwp_15 = GWP(L=dæk_2.gwp, S=type_3_6, M=dæk_2.bygningsdel)
gwp_16 = GWP(L=dæk_2.gwp, S=type_4_6, M=dæk_2.bygningsdel)
gwp_17 = GWP(L=dæk_2.gwp, S=type_5_4, M=dæk_2.bygningsdel)
gwp_18 = GWP(L=dæk_2.gwp, S=type_6_4, M=dæk_2.bygningsdel)
gwp_19 = GWP(L=dæk_2.gwp, S=type_7_5, M=dæk_2.bygningsdel)
gwp_20 = GWP(L=dæk_2.gwp, S=type_8_3, M=dæk_2.bygningsdel)
gwp_type_1_1m2_6 = Panel(gwp_13)
multiplication_16 = Multiplication(A=gwp_13, B=num_10)
gwp_type_2_1m2_2 = Panel(gwp_14)
multiplication_17 = Multiplication(A=gwp_14, B=num_11)
gwp_type_3_1m2_2 = Panel(gwp_15)
multiplication_18 = Multiplication(A=gwp_15, B=num_12)
gwp_type_4_1m2_2 = Panel(gwp_16)
multiplication_19 = Multiplication(A=gwp_16, B=num_13)
gwp_type_5_1m2_2 = Panel(gwp_17)
multiplication_20 = Multiplication(A=gwp_17, B=num_14)
gwp_type_6_1m2_2 = Panel(gwp_18)
multiplication_21 = Multiplication(A=gwp_18, B=num_15)
gwp_type_7_1m2_2 = Panel(gwp_19)
multiplication_22 = Multiplication(A=gwp_19, B=num_16)
gwp_type_8_1m2_2 = Panel(gwp_20)
multiplication_23 = Multiplication(A=gwp_20, B=num_17)
type_1_11 = Type8(gwp=multiplication_16, antal=num_10)  # -> gwp_2, antal_2
type_2_7 = Type8(gwp=multiplication_17, antal=num_11)  # -> gwp_2, antal_2
type_3_7 = Type8(gwp=multiplication_18, antal=num_12)  # -> gwp_2, antal_2
type_4_7 = Type8(gwp=multiplication_19, antal=num_13)  # -> gwp_2, antal_2
type_5_5 = Type8(gwp=multiplication_20, antal=num_14)  # -> gwp_2, antal_2
type_6_5 = Type8(gwp=multiplication_21, antal=num_15)  # -> gwp_2, antal_2
type_7_6 = Type8(gwp=multiplication_22, antal=num_16)  # -> gwp_2, antal_2
type_8_4 = Type8(gwp=multiplication_23, antal=num_17)  # -> gwp_2, antal_2
addition_4 = Addition(
    Type1=multiplication_16,
    Type2=multiplication_17,
    Type3=multiplication_18,
    Type4=multiplication_19,
    Type5=multiplication_20,
    Type6=multiplication_21,
    Type7=multiplication_22,
    Type8=multiplication_23)
entwine_5 = Entwine(
    Branch00=[type_1_10, type_1_11.gwp_2, type_1_11.antal_2],
    Branch01=[type_2_6, type_2_7.gwp_2, type_2_7.antal_2],
    Branch02=[type_3_6, type_3_7.gwp_2, type_3_7.antal_2],
    Branch03=[type_4_6, type_4_7.gwp_2, type_4_7.antal_2],
    Branch04=[type_5_4, type_5_5.gwp_2, type_5_5.antal_2],
    Branch05=[type_6_4, type_6_5.gwp_2, type_6_5.antal_2],
    Branch06=[type_7_5, type_7_6.gwp_2, type_7_6.antal_2],
    Branch07=[type_8_3, type_8_4.gwp_2, type_8_4.antal_2],
    FlattenInputs=True)
samlet_co2_eq_for_dæk = Panel(addition_4)
samlet_co2_eq_pr_bygningsdel_3 = Panel(entwine_5)

# ---- group: Resultat / Udregning af resultat (continued)
num_18 = Number(samlet_co2_eq_for_dæk)

# ---- group: Resultat / Analyse af resultat (continued)
bygningsdele_3 = Data([type_1_10, type_2_6, type_3_6, type_4_6, type_5_4, type_6_4, type_7_5, type_8_3])

# ---- group: Grafer / Grafer - Bygningsdele (continued)
entwine_6 = Entwine(
    Branch00=[type_1_10, multiplication_16],
    Branch01=[type_2_6, multiplication_17],
    Branch02=[type_3_6, multiplication_18],
    Branch03=[type_4_6, multiplication_19],
    Branch04=[type_5_4, multiplication_20],
    Branch05=[type_6_4, multiplication_21],
    Branch06=[type_7_5, multiplication_22],
    Branch07=[type_8_3, multiplication_23],
    FlattenInputs=True)
item_11 = ListItem(List=entwine_6, Index=0, Wrap=True)  # -> flatten(Item)
item_12 = ListItem(List=entwine_6, Index=Slider(1, range=0..1), Wrap=True)  # -> flatten(Item)
chart_3 = CreateChart(
    ChartName=overskrift_4,
    ChartSeries="Dæk",
    ChartXAxisLabels=item_11,
    ValueTree=item_12,
    Chart_Theme="Bright Pastel",
    Chart_Type="Column")

# ---- group: Terrændæk / Beregning af CO2 aftryk
true_false_8 = Boolean(load_unload)
filsti_8 = FilePath(fill_sti)
terrændæk_2 = Terrændæk(read=true_false_8, path=filsti_8)  # -> gwp, bygningsdel
type_1_12 = Type1(T=element_type_picker_4, L=antal_elementer_der_tælles_med_i_query_e)  # -> G, R
type_2_8 = Type1(T=element_type_picker_7, L=antal_elementer_der_tælles_med_i_query_e)  # -> G, R
type_3_8 = Type1(T=element_type_picker_14, L=antal_elementer_der_tælles_med_i_query_e)  # -> G, R
type_4_8 = Type1(T=element_type_picker_21, L=antal_elementer_der_tælles_med_i_query_e)  # -> G, R
type_5_6 = Type1(T=element_type_picker_27, L=antal_elementer_der_tælles_med_i_query_e)  # -> G, R
type_6_6 = Type1(T=element_type_picker_31, L=antal_elementer_der_tælles_med_i_query_e)  # -> G, R
type_7_7 = Type1(T=element_type_picker_37, L=antal_elementer_der_tælles_med_i_query_e)  # -> G, R
type_8_5 = Type1(T=element_type_picker_41, L=antal_elementer_der_tælles_med_i_query_e)  # -> G, R
cluster_6 = Cluster(
    E=elements_4.Elements,
    E_2=[element_type_picker_4, element_type_picker_7, element_type_picker_14, element_type_picker_21, element_type_picker_27, element_type_picker_31, element_type_picker_37, element_type_picker_41])
geo_41 = Geometry(type_1_12.G)
num_19 = Number(type_1_12.R)
geo_42 = Geometry(type_2_8.G)
num_20 = Number(type_2_8.R)
geo_43 = Geometry(type_3_8.G)
num_21 = Number(type_3_8.R)
geo_44 = Geometry(type_4_8.G)
num_22 = Number(type_4_8.R)
geo_45 = Geometry(type_5_6.G)
num_23 = Number(type_5_6.R)
geo_46 = Geometry(type_6_6.G)
num_24 = Number(type_6_6.R)
geo_47 = Geometry(type_7_7.G)
num_25 = Number(type_7_7.R)
geo_48 = Geometry(type_8_5.G)
num_26 = Number(type_8_5.R)
overskydende_revit_elementer_4 = Panel(cluster_6)

# ---- group: Terrændæk
geo_49 = Geometry(geo_41)

type_1_13 = ItemSelector(
    terrændæk_2.bygningsdel,
    {"13 / Gen. / Beton / Linoleum", "13 / Gen. / Beton / Parket svømmende", "13 / Gen. / Beton / Trægulv strøer", "13 / Gen. / Træelement / Trægulv strøer"}, selected="13 / Gen. / Beton / Trægulv strøer")
preview_21 = CustomPreview(Geometry=geo_49, Material=ColourSwatch(SwatchColor=RGB(255, 0, 0)))

type_2_9 = ItemSelector(
    terrændæk_2.bygningsdel,
    {"13 / Gen. / Beton / Betonslidlag", "13 / Gen. / Beton / Klinker", "13 / Gen. / Beton / Linoleum", "13 / Gen. / Beton / Parket svømmende", "13 / Gen. / Beton / Trægulv strøer", "13 / Gen. / Beton / Vinyl", "13 / Gen. / Træelement / Klinker", "13 / Gen. / Træelement / Linoleum", "13 / Gen. / Træelement / Parket svømmende", "13 / Gen. / Træelement / Trægulv strøer", "13 / Gen. / Træelement / Vinyl"}, selected="13 / Gen. / Beton / Betonslidlag")  # disabled
geo_50 = Geometry(geo_42)
preview_22 = CustomPreview(Geometry=geo_50, Material=ColourSwatch(SwatchColor=RGB(230, 0, 0)))

type_3_9 = ItemSelector(
    terrændæk_2.bygningsdel,
    {"23 / Gen. / Beton Huldæk / Maling, Betonslidlag", "23 / Gen. / Beton Huldæk / Maling, Klinker", "23 / Gen. / Beton Huldæk / Maling, Linoleum", "23 / Gen. / Beton Huldæk / Maling, Parket svømmende", "23 / Gen. / Beton Huldæk / Maling, Trægulv strøer", "23 / Gen. / Beton Huldæk / Maling, Vinyl"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}, selected="23 / Gen. / Beton Huldæk / Maling, Betonslidlag")  # disabled
geo_51 = Geometry(geo_43)
preview_23 = CustomPreview(Geometry=geo_51, Material=ColourSwatch(SwatchColor=RGB(204, 0, 0)))

type_4_9 = ItemSelector(
    terrændæk_2.bygningsdel,
    {"23 / Gen. / Beton Huldæk / Maling, Betonslidlag", "23 / Gen. / Beton Huldæk / Maling, Klinker", "23 / Gen. / Beton Huldæk / Maling, Linoleum", "23 / Gen. / Beton Huldæk / Maling, Parket svømmende", "23 / Gen. / Beton Huldæk / Maling, Trægulv strøer", "23 / Gen. / Beton Huldæk / Maling, Vinyl"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}, selected="23 / Gen. / Beton Huldæk / Maling, Betonslidlag")  # disabled
geo_52 = Geometry(geo_44)
preview_24 = CustomPreview(Geometry=geo_52, Material=ColourSwatch(SwatchColor=RGB(178, 0, 0)))

type_5_7 = ItemSelector(
    terrændæk_2.bygningsdel,
    {"21 / Gen. / Beton 150 mm. / Alupaneler": "21 / Gen. / Beton 150 mm. / Alupaneler ", "21 / Gen. / Beton 150 mm. / Nåletræ", "21 / Gen. / Beton 150 mm. / Skærmtegl Alu ophæng", "21 / Gen. / Beton 150 mm. / Skærmtegl Træ ophæng", "21 / Gen. / Beton 150 mm. / Traditionel Teglsten", "21 / Gen. / Beton 150 mm. / Zink, Stående Fals", "21 / Gen. / CLT 150 mm. / Nåletræ", "21 / Gen. / CLT 150 mm. / Skærmtegl Træ ophæng", "21 / Gen. / Stål / Alupaneler", "21 / Gen. / Stål / Nåletræ"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}, selected="21 / Gen. / Beton 150 mm. / Alupaneler")  # disabled
geo_53 = Geometry(geo_45)
preview_25 = CustomPreview(Geometry=geo_53, Material=ColourSwatch(SwatchColor=RGB(153, 0, 0)))

type_6_7 = ItemSelector(
    terrændæk_2.bygningsdel,
    {"21 / Gen. / Beton 150 mm. / Alupaneler": "21 / Gen. / Beton 150 mm. / Alupaneler ", "21 / Gen. / Beton 150 mm. / Nåletræ", "21 / Gen. / Beton 150 mm. / Skærmtegl Alu ophæng", "21 / Gen. / Beton 150 mm. / Skærmtegl Træ ophæng", "21 / Gen. / Beton 150 mm. / Traditionel Teglsten", "21 / Gen. / Beton 150 mm. / Zink, Stående Fals", "21 / Gen. / CLT 150 mm. / Nåletræ", "21 / Gen. / CLT 150 mm. / Skærmtegl Træ ophæng", "21 / Gen. / Stål / Alupaneler", "21 / Gen. / Stål / Nåletræ"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}, selected="21 / Gen. / Beton 150 mm. / Alupaneler")  # disabled
geo_54 = Geometry(geo_46)
preview_26 = CustomPreview(Geometry=geo_54, Material=ColourSwatch(SwatchColor=RGB(128, 0, 0)))

type_7_8 = ItemSelector(
    terrændæk_2.bygningsdel,
    {"21 / Gen. / Beton 150 mm. / Alupaneler": "21 / Gen. / Beton 150 mm. / Alupaneler ", "21 / Gen. / Beton 150 mm. / Nåletræ", "21 / Gen. / Beton 150 mm. / Skærmtegl Alu ophæng", "21 / Gen. / Beton 150 mm. / Skærmtegl Træ ophæng", "21 / Gen. / Beton 150 mm. / Traditionel Teglsten", "21 / Gen. / Beton 150 mm. / Zink, Stående Fals", "21 / Gen. / CLT 150 mm. / Nåletræ", "21 / Gen. / CLT 150 mm. / Skærmtegl Træ ophæng", "21 / Gen. / Stål / Alupaneler", "21 / Gen. / Stål / Nåletræ"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}, selected="21 / Gen. / Beton 150 mm. / Alupaneler")  # disabled
geo_55 = Geometry(geo_47)
preview_27 = CustomPreview(Geometry=geo_55, Material=ColourSwatch(SwatchColor=RGB(102, 0, 0)))

type_8_6 = ItemSelector(
    terrændæk_2.bygningsdel,
    {"21 / Gen. / Beton 150 mm. / Alupaneler": "21 / Gen. / Beton 150 mm. / Alupaneler ", "21 / Gen. / Beton 150 mm. / Nåletræ", "21 / Gen. / Beton 150 mm. / Skærmtegl Alu ophæng", "21 / Gen. / Beton 150 mm. / Skærmtegl Træ ophæng", "21 / Gen. / Beton 150 mm. / Traditionel Teglsten", "21 / Gen. / Beton 150 mm. / Zink, Stående Fals", "21 / Gen. / CLT 150 mm. / Nåletræ", "21 / Gen. / CLT 150 mm. / Skærmtegl Træ ophæng", "21 / Gen. / Stål / Alupaneler", "21 / Gen. / Stål / Nåletræ"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}, selected="21 / Gen. / Beton 150 mm. / Alupaneler")  # disabled
geo_56 = Geometry(geo_48)
preview_28 = CustomPreview(Geometry=geo_56, Material=ColourSwatch(SwatchColor=RGB(76, 0, 0)))

# ---- group: Terrændæk / Beregning af CO2 aftryk (continued)
gwp_21 = GWP(L=terrændæk_2.gwp, S=type_1_13, M=terrændæk_2.bygningsdel)
gwp_22 = GWP(L=terrændæk_2.gwp, S=type_2_9, M=terrændæk_2.bygningsdel)
gwp_23 = GWP(L=terrændæk_2.gwp, S=type_3_9, M=terrændæk_2.bygningsdel)
gwp_24 = GWP(L=terrændæk_2.gwp, S=type_4_9, M=terrændæk_2.bygningsdel)
gwp_25 = GWP(L=terrændæk_2.gwp, S=type_5_7, M=terrændæk_2.bygningsdel)
gwp_26 = GWP(L=terrændæk_2.gwp, S=type_6_7, M=terrændæk_2.bygningsdel)
gwp_27 = GWP(L=terrændæk_2.gwp, S=type_7_8, M=terrændæk_2.bygningsdel)
gwp_28 = GWP(L=terrændæk_2.gwp, S=type_8_6, M=terrændæk_2.bygningsdel)
gwp_type_2_1m2_3 = Panel(gwp_22)
multiplication_24 = Multiplication(A=gwp_22, B=num_20)
gwp_type_3_1m2_3 = Panel(gwp_23)
multiplication_25 = Multiplication(A=gwp_23, B=num_21)
gwp_type_1_1m2_7 = Panel(gwp_21)
multiplication_26 = Multiplication(A=gwp_21, B=num_19)
gwp_type_4_1m2_3 = Panel(gwp_24)
multiplication_27 = Multiplication(A=gwp_24, B=num_22)
gwp_type_5_1m2_3 = Panel(gwp_25)
multiplication_28 = Multiplication(A=gwp_25, B=num_23)
gwp_type_6_1m2_3 = Panel(gwp_26)
multiplication_29 = Multiplication(A=gwp_26, B=num_24)
gwp_type_7_1m2_3 = Panel(gwp_27)
multiplication_30 = Multiplication(A=gwp_27, B=num_25)
gwp_type_8_1m2_3 = Panel(gwp_28)
multiplication_31 = Multiplication(A=gwp_28, B=num_26)
type_1_14 = Type8(gwp=multiplication_26, antal=num_19)  # -> gwp_2, antal_2
type_2_10 = Type8(gwp=multiplication_24, antal=num_20)  # -> gwp_2, antal_2
type_3_10 = Type8(gwp=multiplication_25, antal=num_21)  # -> gwp_2, antal_2
type_4_10 = Type8(gwp=multiplication_27, antal=num_22)  # -> gwp_2, antal_2
type_5_8 = Type8(gwp=multiplication_28, antal=num_23)  # -> gwp_2, antal_2
type_6_8 = Type8(gwp=multiplication_29, antal=num_24)  # -> gwp_2, antal_2
type_7_9 = Type8(gwp=multiplication_30, antal=num_25)  # -> gwp_2, antal_2
type_8_7 = Type8(gwp=multiplication_31, antal=num_26)  # -> gwp_2, antal_2
addition_5 = Addition(
    Type1=multiplication_26,
    Type2=multiplication_24,
    Type3=multiplication_25,
    Type4=multiplication_27,
    Type5=multiplication_28,
    Type6=multiplication_29,
    Type7=multiplication_30,
    Type8=multiplication_31)
entwine_7 = Entwine(
    Branch00=[type_1_13, type_1_14.gwp_2, type_1_14.antal_2],
    Branch01=[type_2_9, type_2_10.gwp_2, type_2_10.antal_2],
    Branch02=[type_3_9, type_3_10.gwp_2, type_3_10.antal_2],
    Branch03=[type_4_9, type_4_10.gwp_2, type_4_10.antal_2],
    Branch04=[type_5_7, type_5_8.gwp_2, type_5_8.antal_2],
    Branch05=[type_6_7, type_6_8.gwp_2, type_6_8.antal_2],
    Branch06=[type_7_8, type_7_9.gwp_2, type_7_9.antal_2],
    Branch07=[type_8_6, type_8_7.gwp_2, type_8_7.antal_2],
    FlattenInputs=True)
samlet_co2_eq_for_terrændæk = Panel(addition_5)
samlet_co2_eq_pr_bygningsdel_4 = Panel(entwine_7)

# ---- group: Resultat / Udregning af resultat (continued)
num_27 = Number(addition_5)

# ---- group: Resultat / Analyse af resultat (continued)
bygningsdele_4 = Data([type_1_13, type_2_9, type_3_9, type_4_9, type_5_7, type_6_7, type_7_8, type_8_6])

# ---- group: Grafer / Grafer - Bygningsdele (continued)
entwine_8 = Entwine(
    Branch00=[type_1_13, multiplication_26],
    Branch01=[type_2_9, multiplication_24],
    Branch02=[type_3_9, multiplication_25],
    Branch03=[type_4_9, multiplication_27],
    Branch04=[type_5_7, multiplication_28],
    Branch05=[type_6_7, multiplication_29],
    Branch06=[type_7_8, multiplication_30],
    Branch07=[type_8_6, multiplication_31],
    FlattenInputs=True)
item_13 = ListItem(List=entwine_8, Index=0, Wrap=True)  # -> flatten(Item)
item_14 = ListItem(List=entwine_8, Index=Slider(1, range=0..1), Wrap=True)  # -> flatten(Item)
chart_4 = CreateChart(
    ChartName=overskrift_5,
    ChartSeries="Terrændæk",
    ChartXAxisLabels=item_13,
    ValueTree=item_14,
    Chart_Theme="Bright Pastel",
    Chart_Type="Column")

# ---- group: Vinduer, Døre og Glasfacader
true_false_9 = Boolean(load_unload)
filsti_9 = FilePath(fill_sti)
vinduer_døre_glasfacader = VinduerDøreGlasfacader(read=true_false_9, path=filsti_9)  # -> gwp, bygningsdel
type_4_11 = ItemSelector(
    vinduer_døre_glasfacader.bygningsdel,
    {"31 / Gen. / Udvendig / Dør, alu", "31 / Gen. / Udvendig / Dør, træ", "32 / Gen. / Indvendig / Dør, træ", "32 / Gen. / Indvendig / Glasdør, træ", "31 / Gen. / Glasfacade / Alu", "31 / Gen. / Glasfacade / Stål", "31 / Gen. / Vindue / Alu", "31 / Gen. / Vindue / Træ", "31 / Gen. / Vindue / Træ-Alu"}, selected="31 / Gen. / Glasfacade / Alu")
cluster_7 = Cluster(
    E=elements_6.Elements,
    E_2=[element_type_picker_5, element_type_picker_8, element_type_picker_13, element_type_picker_19])
type_1_15 = Type1_4(T=element_type_picker_5, L=antal_elementer_der_tælles_med_i_query_e)  # -> G, L_2
type_2_11 = Type1_4(T=element_type_picker_8, L=antal_elementer_der_tælles_med_i_query_e)  # -> G, L_2
type_3_11 = Type1_4(T=element_type_picker_13, L=antal_elementer_der_tælles_med_i_query_e)  # -> G, L_2
type_4_12 = Type1_4(T=element_type_picker_19, L=antal_elementer_der_tælles_med_i_query_e)  # -> G, L_2
vinduer = Vinduer_2(T=element_type_picker_29, L=antal_elementer_der_tælles_med_i_query_e)  # -> G, R
gwp_29 = GWP(L=vinduer_døre_glasfacader.gwp, S=type_4_11, M=vinduer_døre_glasfacader.bygningsdel)
overskydende_revit_elementer_5 = Panel(cluster_7)
geo_57 = Geometry(type_1_15.G)
geo_58 = Geometry(geo_57)
antal_5 = Number(type_1_15.L_2)
geo_59 = Geometry(type_2_11.G)
antal_6 = Number(type_2_11.L_2)
geo_60 = Geometry(type_3_11.G)
antal_7 = Number(type_3_11.L_2)
geo_61 = Geometry(type_4_12.G)
antal_8 = Number(type_4_12.L_2)
geo_62 = Geometry(vinduer.G)
geo_63 = Geometry(geo_62)
areal_9 = Number(vinduer.R)
geo_64 = Geometry(cluster_3.E)
geo_65 = Geometry(geo_64)
areal_10 = Number(cluster_3.R)
gwp_type_1_1m2_8 = Panel(gwp_29)

type_1_16 = ItemSelector(
    vinduer_døre_glasfacader.bygningsdel,
    {"31 / Gen. / Udvendig / Dør, alu", "31 / Gen. / Udvendig / Dør, træ", "32 / Gen. / Indvendig / Dør, træ", "32 / Gen. / Indvendig / Glasdør, træ", "31 / Gen. / Glasfacade / Alu", "31 / Gen. / Glasfacade / Stål", "31 / Gen. / Vindue / Alu", "31 / Gen. / Vindue / Træ", "31 / Gen. / Vindue / Træ-Alu"}, selected="31 / Gen. / Udvendig / Dør, alu")
preview_29 = CustomPreview(Geometry=geo_58, Material=ColourSwatch(SwatchColor=RGB(0, 255, 0)))

type_2_12 = ItemSelector(
    vinduer_døre_glasfacader.bygningsdel,
    {"31 / Gen. / Udvendig / Dør, alu", "31 / Gen. / Udvendig / Dør, træ", "32 / Gen. / Indvendig / Dør, træ", "32 / Gen. / Indvendig / Glasdør, træ", "31 / Gen. / Glasfacade / Alu", "31 / Gen. / Glasfacade / Stål", "31 / Gen. / Vindue / Alu", "31 / Gen. / Vindue / Træ", "31 / Gen. / Vindue / Træ-Alu"}, selected="32 / Gen. / Indvendig / Dør, træ")
geo_66 = Geometry(geo_59)
preview_30 = CustomPreview(Geometry=geo_66, Material=ColourSwatch(SwatchColor=RGB(0, 128, 0)))

type_3_12 = ItemSelector(
    vinduer_døre_glasfacader.bygningsdel,
    {"31 / Gen. / Udvendig / Dør, alu", "31 / Gen. / Udvendig / Dør, træ", "32 / Gen. / Indvendig / Dør, træ", "32 / Gen. / Indvendig / Glasdør, træ", "31 / Gen. / Glasfacade / Alu", "31 / Gen. / Glasfacade / Stål", "31 / Gen. / Vindue / Alu", "31 / Gen. / Vindue / Træ", "31 / Gen. / Vindue / Træ-Alu"}, selected="32 / Gen. / Indvendig / Glasdør, træ")
geo_67 = Geometry(geo_60)
preview_31 = CustomPreview(Geometry=geo_67, Material=ColourSwatch(SwatchColor=RGB(0, 178, 0)))

type_4_13 = ItemSelector(
    vinduer_døre_glasfacader.bygningsdel,
    {"31 / Gen. / Udvendig / Dør, alu", "31 / Gen. / Udvendig / Dør, træ", "32 / Gen. / Indvendig / Dør, træ", "32 / Gen. / Indvendig / Glasdør, træ", "31 / Gen. / Glasfacade / Alu", "31 / Gen. / Glasfacade / Stål", "31 / Gen. / Vindue / Alu", "31 / Gen. / Vindue / Træ", "31 / Gen. / Vindue / Træ-Alu"}, selected="32 / Gen. / Indvendig / Glasdør, træ")
geo_68 = Geometry(geo_61)
preview_32 = CustomPreview(Geometry=geo_68, Material=ColourSwatch(SwatchColor=RGB(0, 140, 0)))

type_4_14 = ItemSelector(
    vinduer_døre_glasfacader.bygningsdel,
    {"31 / Gen. / Udvendig / Dør, alu", "31 / Gen. / Udvendig / Dør, træ", "32 / Gen. / Indvendig / Dør, træ", "32 / Gen. / Indvendig / Glasdør, træ", "31 / Gen. / Glasfacade / Alu", "31 / Gen. / Glasfacade / Stål", "31 / Gen. / Vindue / Alu", "31 / Gen. / Vindue / Træ", "31 / Gen. / Vindue / Træ-Alu"}, selected="31 / Gen. / Udvendig / Dør, alu")
preview_33 = CustomPreview(Geometry=geo_63, Material=swatch)

preview_34 = CustomPreview(Geometry=geo_65, Material=swatch)

gwp_30 = GWP(L=vinduer_døre_glasfacader.gwp, S=type_1_16, M=vinduer_døre_glasfacader.bygningsdel)
gwp_31 = GWP(L=vinduer_døre_glasfacader.gwp, S=type_2_12, M=vinduer_døre_glasfacader.bygningsdel)
gwp_32 = GWP(L=vinduer_døre_glasfacader.gwp, S=type_3_12, M=vinduer_døre_glasfacader.bygningsdel)
gwp_33 = GWP(L=vinduer_døre_glasfacader.gwp, S=type_4_13, M=vinduer_døre_glasfacader.bygningsdel)
gwp_34 = GWP(L=vinduer_døre_glasfacader.gwp, S=type_4_14, M=vinduer_døre_glasfacader.bygningsdel)
multiplication_32 = Multiplication(A=gwp_31, B=antal_6)
gwp_type_1_1m2_9 = Panel(gwp_32)
multiplication_33 = Multiplication(A=gwp_32, B=antal_7)
gwp_type_1_1m2_10 = Panel(gwp_33)
multiplication_34 = Multiplication(A=gwp_33, B=antal_8)
gwp_type_1_1m2_11 = Panel(gwp_34)
multiplication_35 = Multiplication(A=gwp_33, B=areal_9)
multiplication_36 = Multiplication(A=gwp_33, B=areal_10)
gwp_type_1_1m2_12 = Panel(gwp_31)
gwp_type_1_1m2_13 = Panel(gwp_30)
multiplication_37 = Multiplication(A=gwp_30, B=antal_5)
type_1_17 = Type1_5(gwp=multiplication_37, antal=antal_5)  # -> gwp_2, antal_2
type_2_13 = Type1_5(gwp=multiplication_32, antal=antal_6)  # -> gwp_2, antal_2
type_3_13 = Type1_5(gwp=multiplication_33, antal=antal_7)  # -> gwp_2, antal_2
type_3_14 = Type1_5(gwp=multiplication_34, antal=antal_8)  # -> gwp_2, antal_2
vinduer_2 = Vinduer(gwp=multiplication_35, antal=areal_9)  # -> gwp_2, antal_2
glasfacader = Glasfacader(gwp=multiplication_36, antal=areal_10)  # -> gwp_2, areal
addition_6 = Addition(
    Type1=multiplication_37,
    Type2=multiplication_32,
    Type3=multiplication_33,
    Type4=multiplication_34,
    Vindue=multiplication_35,
    GlasFacade=glasfacader.gwp_2)
entwine_9 = Entwine(
    Branch00=[type_1_16, type_1_17.antal_2, type_1_17.gwp_2],
    Branch01=[type_2_12, type_2_13.antal_2, type_2_13.gwp_2],
    Branch02=[type_3_12, type_3_13.antal_2, type_3_13.gwp_2],
    Branch03=[type_4_13, type_3_14.antal_2, type_3_14.gwp_2],
    Branch04=[type_4_14, vinduer_2.antal_2, vinduer_2.gwp_2],
    Branch05=[type_4_11, glasfacader.areal, glasfacader.gwp_2],
    FlattenInputs=True)
samlet_co2_eq_for_vinduer_døre_glasfacad = Panel(addition_6)  # "Samlet CO2-eq. for Vinduer, Døre, Glasfacader"
samlet_co2_eq_pr_vinduer_døre_glasfacade = Panel(entwine_9)  # "Samlet CO2-eq. pr. Vinduer, Døre, Glasfacader"

# ---- group: Resultat / Udregning af resultat (continued)
num_28 = Number(addition_6)

# ---- group: Resultat / Analyse af resultat (continued)
bygningsdele_5 = Data([type_1_16, type_2_12, type_3_12, type_4_13, type_4_14, type_4_11])

# ---- group: Grafer / Grafer - Bygningsdele (continued)
entwine_10 = Entwine(
    Branch00=[type_1_16, multiplication_37],
    Branch01=[type_2_12, multiplication_32],
    Branch02=[type_3_12, multiplication_33],
    Branch03=[type_4_13, multiplication_34],
    Branch04=[type_4_14, multiplication_35],
    Branch05=[type_4_11, multiplication_36],
    FlattenInputs=True)
item_15 = ListItem(List=entwine_10, Index=0, Wrap=True)  # -> flatten(Item)
item_16 = ListItem(List=entwine_10, Index=Slider(1, range=0..1), Wrap=True)  # -> flatten(Item)
chart_5 = CreateChart(
    ChartName=overskrift_7,
    ChartSeries="Vinduer - Døre - Glasfacader",
    ChartXAxisLabels=item_15,
    ValueTree=item_16,
    Chart_Theme="Bright Pastel",
    Chart_Type="Column")

# ---- group: Tage / Beregning af CO2 aftryk
filsti_10 = FilePath(fill_sti)
true_false_10 = Boolean(load_unload)
tage = Tage(read=true_false_10, path=filsti_10)  # -> gwp, bygningsdel
type_1_18 = Type1(T=element_type_picker_6, L=antal_elementer_der_tælles_med_i_query_e)  # -> G, R
type_2_14 = Type1(T=element_type_picker_11, L=antal_elementer_der_tælles_med_i_query_e)  # -> G, R
type_3_15 = Type1(T=element_type_picker_17, L=antal_elementer_der_tælles_med_i_query_e)  # -> G, R
type_4_15 = Type1(T=element_type_picker_23, L=antal_elementer_der_tælles_med_i_query_e)  # -> G, R
type_5_9 = Type1(T=element_type_picker_28, L=antal_elementer_der_tælles_med_i_query_e)  # -> G, R
type_6_9 = Type1(T=element_type_picker_33, L=antal_elementer_der_tælles_med_i_query_e)  # -> G, R
type_7_10 = Type1(T=element_type_picker_35, L=antal_elementer_der_tælles_med_i_query_e)  # -> G, R
type_8_8 = Type1(T=element_type_picker_40, L=antal_elementer_der_tælles_med_i_query_e)  # -> G, R
cluster_8 = Cluster(
    E=elements_2.Elements,
    E_2=[element_type_picker_6, element_type_picker_11, element_type_picker_17, element_type_picker_23, element_type_picker_28, element_type_picker_33, element_type_picker_35, element_type_picker_40])
geo_69 = Geometry(type_2_14.G)
num_29 = Number(type_4_15.R)
num_30 = Number(type_7_10.R)
num_31 = Number(type_8_8.R)
geo_70 = Geometry(type_1_18.G)
num_32 = Number(type_1_18.R)
num_33 = Number(type_2_14.R)
geo_71 = Geometry(type_3_15.G)
num_34 = Number(type_3_15.R)
geo_72 = Geometry(type_4_15.G)
geo_73 = Geometry(type_5_9.G)
num_35 = Number(type_5_9.R)
geo_74 = Geometry(type_6_9.G)
num_36 = Number(type_6_9.R)
geo_75 = Geometry(type_7_10.G)
geo_76 = Geometry(type_8_8.G)
overskydende_revit_elementer_6 = Panel(cluster_8)

# ---- group: Tage (continued)
type_1_19 = ItemSelector(
    tage.bygningsdel,
    {"27 / Gen. / Beton / Sedum, Nedhængt", "27 / Gen. / Beton / Tegl, Nedhængt", "27 / Gen. / CLT / Tagpap, Nedhængt", "27 / Gen. / Præfab. Gitterspær / Sedum, Nedhængt", "27 / Gen. / Præfab. Gitterspær / Tagpap, Nedhængt", "27 / Gen. / Præfab. Gitterspær / Tegl, Nedhængt", "27 / Gen. / Træelement / Sedum, Nedhængt", "27 / Gen. / Træelement / Tegl, Nedhængt"}, selected="27 / Gen. / Præfab. Gitterspær / Tagpap, Nedhængt")
geo_77 = Geometry(geo_70)
preview_35 = CustomPreview(Geometry=geo_77, Material=ColourSwatch(SwatchColor=RGBA(255, 85, 0, 110)))

type_2_15 = ItemSelector(
    tage.bygningsdel,
    {"27 / Gen. / Beton / Sedum, Maling", "27 / Gen. / Beton / Sedum, Nedhængt", "27 / Gen. / Beton / Sedum, Træbeton", "27 / Gen. / Beton / Sedum, Trælameller", "27 / Gen. / Beton / Stål, Maling", "27 / Gen. / Beton / Stål, Nedhængt"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}, selected="27 / Gen. / Beton / Sedum, Maling")  # disabled
geo_78 = Geometry(geo_69)
preview_36 = CustomPreview(Geometry=geo_78, Material=ColourSwatch(SwatchColor=RGBA(230, 76, 0, 110)))

type_3_16 = ItemSelector(
    tage.bygningsdel,
    {"27 / Gen. / Beton / Sedum, Maling", "27 / Gen. / Beton / Sedum, Nedhængt", "27 / Gen. / Beton / Sedum, Træbeton", "27 / Gen. / Beton / Sedum, Trælameller", "27 / Gen. / Beton / Stål, Maling", "27 / Gen. / Beton / Stål, Nedhængt"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}, selected="27 / Gen. / Beton / Sedum, Maling")  # disabled
geo_79 = Geometry(geo_71)
preview_37 = CustomPreview(Geometry=geo_79, Material=ColourSwatch(SwatchColor=RGBA(204, 68, 0, 110)))

type_4_16 = ItemSelector(
    tage.bygningsdel,
    {"27 / Gen. / Beton / Sedum, Maling", "27 / Gen. / Beton / Sedum, Nedhængt", "27 / Gen. / Beton / Sedum, Træbeton", "27 / Gen. / Beton / Sedum, Trælameller", "27 / Gen. / Beton / Stål, Maling", "27 / Gen. / Beton / Stål, Nedhængt"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}, selected="27 / Gen. / Beton / Sedum, Maling")  # disabled
geo_80 = Geometry(geo_72)
preview_38 = CustomPreview(Geometry=geo_80, Material=ColourSwatch(SwatchColor=RGBA(178, 59, 0, 110)))

type_5_10 = ItemSelector(
    tage.bygningsdel,
    {"21 / Gen. / Beton 150 mm. / Alupaneler": "21 / Gen. / Beton 150 mm. / Alupaneler ", "21 / Gen. / Beton 150 mm. / Nåletræ", "21 / Gen. / Beton 150 mm. / Skærmtegl Alu ophæng", "21 / Gen. / Beton 150 mm. / Skærmtegl Træ ophæng", "21 / Gen. / Beton 150 mm. / Traditionel Teglsten", "21 / Gen. / Beton 150 mm. / Zink, Stående Fals", "21 / Gen. / CLT 150 mm. / Nåletræ", "21 / Gen. / CLT 150 mm. / Skærmtegl Træ ophæng", "21 / Gen. / Stål / Alupaneler", "21 / Gen. / Stål / Nåletræ"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}, selected="21 / Gen. / Beton 150 mm. / Alupaneler")  # disabled
geo_81 = Geometry(geo_73)
preview_39 = CustomPreview(Geometry=geo_81, Material=ColourSwatch(SwatchColor=RGBA(153, 51, 0, 110)))

type_6_10 = ItemSelector(
    tage.bygningsdel,
    {"21 / Gen. / Beton 150 mm. / Alupaneler": "21 / Gen. / Beton 150 mm. / Alupaneler ", "21 / Gen. / Beton 150 mm. / Nåletræ", "21 / Gen. / Beton 150 mm. / Skærmtegl Alu ophæng", "21 / Gen. / Beton 150 mm. / Skærmtegl Træ ophæng", "21 / Gen. / Beton 150 mm. / Traditionel Teglsten", "21 / Gen. / Beton 150 mm. / Zink, Stående Fals", "21 / Gen. / CLT 150 mm. / Nåletræ", "21 / Gen. / CLT 150 mm. / Skærmtegl Træ ophæng", "21 / Gen. / Stål / Alupaneler", "21 / Gen. / Stål / Nåletræ"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}, selected="21 / Gen. / Beton 150 mm. / Alupaneler")  # disabled
geo_82 = Geometry(geo_74)
preview_40 = CustomPreview(Geometry=geo_82, Material=ColourSwatch(SwatchColor=RGBA(128, 42, 0, 110)))

# ---- group: Tjek af overskydende elementer i modellen (elementer der ikke er beregnet med) (continued)
overskydende_revit_elementer_tage_og_lof = Panel(cluster_8)  # "Overskydende Revit elementer - Tage og Lofter"

# ---- group: Tage (continued)
type_7_11 = ItemSelector(
    tage.bygningsdel,
    {"21 / Gen. / Beton 150 mm. / Alupaneler": "21 / Gen. / Beton 150 mm. / Alupaneler ", "21 / Gen. / Beton 150 mm. / Nåletræ", "21 / Gen. / Beton 150 mm. / Skærmtegl Alu ophæng", "21 / Gen. / Beton 150 mm. / Skærmtegl Træ ophæng", "21 / Gen. / Beton 150 mm. / Traditionel Teglsten", "21 / Gen. / Beton 150 mm. / Zink, Stående Fals", "21 / Gen. / CLT 150 mm. / Nåletræ", "21 / Gen. / CLT 150 mm. / Skærmtegl Træ ophæng", "21 / Gen. / Stål / Alupaneler", "21 / Gen. / Stål / Nåletræ"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}, selected="21 / Gen. / Beton 150 mm. / Alupaneler")  # disabled
geo_83 = Geometry(geo_75)
preview_41 = CustomPreview(Geometry=geo_83, Material=ColourSwatch(SwatchColor=RGBA(102, 34, 0, 110)))

type_8_9 = ItemSelector(
    tage.bygningsdel,
    {"21 / Gen. / Beton 150 mm. / Alupaneler": "21 / Gen. / Beton 150 mm. / Alupaneler ", "21 / Gen. / Beton 150 mm. / Nåletræ", "21 / Gen. / Beton 150 mm. / Skærmtegl Alu ophæng", "21 / Gen. / Beton 150 mm. / Skærmtegl Træ ophæng", "21 / Gen. / Beton 150 mm. / Traditionel Teglsten", "21 / Gen. / Beton 150 mm. / Zink, Stående Fals", "21 / Gen. / CLT 150 mm. / Nåletræ", "21 / Gen. / CLT 150 mm. / Skærmtegl Træ ophæng", "21 / Gen. / Stål / Alupaneler", "21 / Gen. / Stål / Nåletræ"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}, selected="21 / Gen. / Beton 150 mm. / Alupaneler")  # disabled
geo_84 = Geometry(geo_76)
preview_42 = CustomPreview(Geometry=geo_84, Material=ColourSwatch(SwatchColor=RGBA(76, 25, 0, 110)))

# ---- group: Tage / Beregning af CO2 aftryk (continued)
gwp_35 = GWP(L=tage.gwp, S=type_1_19, M=tage.bygningsdel)
gwp_36 = GWP(L=tage.gwp, S=type_2_15, M=tage.bygningsdel)
gwp_37 = GWP(L=tage.gwp, S=type_3_16, M=tage.bygningsdel)
gwp_38 = GWP(L=tage.gwp, S=type_4_16, M=tage.bygningsdel)
gwp_39 = GWP(L=tage.gwp, S=type_5_10, M=tage.bygningsdel)
gwp_40 = GWP(L=tage.gwp, S=type_6_10, M=tage.bygningsdel)
gwp_41 = GWP(L=tage.gwp, S=type_7_11, M=tage.bygningsdel)
gwp_42 = GWP(L=tage.gwp, S=type_8_9, M=tage.bygningsdel)
multiplication_38 = Multiplication(A=gwp_35, B=num_32)
multiplication_39 = Multiplication(A=gwp_36, B=num_33)
gwp_type_3_1m2_4 = Panel(gwp_37)
multiplication_40 = Multiplication(A=gwp_37, B=num_34)
multiplication_41 = Multiplication(A=gwp_38, B=num_29)
multiplication_42 = Multiplication(A=gwp_39, B=num_35)
multiplication_43 = Multiplication(A=gwp_40, B=num_36)
multiplication_44 = Multiplication(A=gwp_41, B=num_30)
multiplication_45 = Multiplication(A=gwp_42, B=num_31)
gwp_type_1_1m2_14 = Panel(gwp_35)
gwp_type_2_1m2_4 = Panel(gwp_36)
gwp_type_4_1m2_4 = Panel(gwp_38)
gwp_type_5_1m2_4 = Panel(gwp_39)
gwp_type_6_1m2_4 = Panel(gwp_40)
gwp_type_7_1m2_4 = Panel(gwp_41)
gwp_type_8_1m2_4 = Panel(gwp_42)
type_1_20 = Type8(gwp=multiplication_38, antal=num_32)  # -> gwp_2, antal_2
type_2_16 = Type8(gwp=multiplication_39, antal=num_33)  # -> gwp_2, antal_2
type_3_17 = Type8(gwp=multiplication_40, antal=num_34)  # -> gwp_2, antal_2
type_4_17 = Type8(gwp=multiplication_41, antal=num_29)  # -> gwp_2, antal_2
type_5_11 = Type8(gwp=multiplication_42, antal=num_35)  # -> gwp_2, antal_2
type_6_11 = Type8(gwp=multiplication_43, antal=num_36)  # -> gwp_2, antal_2
type_7_12 = Type8(gwp=multiplication_44, antal=num_30)  # -> gwp_2, antal_2
type_8_10 = Type8(gwp=multiplication_45, antal=num_31)  # -> gwp_2, antal_2
addition_7 = Addition(
    Type1=multiplication_38,
    Type2=multiplication_39,
    Type3=multiplication_40,
    Type4=multiplication_41,
    Type5=multiplication_42,
    Type6=multiplication_43,
    Type7=multiplication_44,
    Type8=multiplication_45)
entwine_11 = Entwine(
    Branch00=[type_1_19, type_1_20.gwp_2, type_1_20.antal_2],
    Branch01=[type_2_15, type_2_16.gwp_2, type_2_16.antal_2],
    Branch02=[type_3_16, type_3_17.gwp_2, type_3_17.antal_2],
    Branch03=[type_4_16, type_4_17.gwp_2, type_4_17.antal_2],
    Branch04=[type_5_10, type_5_11.gwp_2, type_5_11.antal_2],
    Branch05=[type_6_10, type_6_11.gwp_2, type_6_11.antal_2],
    Branch06=[type_7_11, type_7_12.gwp_2, type_7_12.antal_2],
    Branch07=[type_8_9, type_8_10.gwp_2, type_8_10.antal_2],
    FlattenInputs=True)
samlet_co2_eq_for_tage_og_lofter = Panel(addition_7)
samlet_co2_eq_pr_bygningsdel_5 = Panel(entwine_11)

# ---- group: Resultat / Udregning af resultat (continued)
num_37 = Number(addition_7)
bygningsdele_6 = Addition(
    TeknikStandardVærdier=num_4,
    YderIndervægge=num_9,
    Tage=num_37,
    Dæk=num_18,
    Terrændæk=num_27,
    Fundamenter=num_8,
    VinduerDøreGlasfacader=num_28)
pr_m2 = Division(Bygnignsdele=bygningsdele_6, BruttoAreal=num_5)
pr_år = Division(UdledningPrM2=pr_m2, Analyseperiode=num_6)
usikkerhedsfaktor_3 = Multiplication(Bygningsdele=pr_år, Usikkerhedsfaktor=usikkerhedsfaktor_2)
addition_8 = Addition(A=pr_år, B=drift_2)
addition_9 = Addition(A=usikkerhedsfaktor_3, B=drift_2)
gwp_co2_eq_m2_år = Panel(addition_8)
gwp_co2_eq_m2_år_m_usikkerhedsfaktor = Panel(addition_9)

# ---- group: Resultat / Analyse af resultat (continued)
bygningsdele_7 = Data([type_1_19, type_2_15, type_3_16, type_4_16, type_5_10, type_6_10, type_7_11, type_8_9])
num_38 = Number(addition_9)
num_39 = Number(pr_år)
num_40 = Number(usikkerhedsfaktor_3)
num_41 = Number(addition_8)
entwine_12 = Entwine(
    Branch00=["Drift", num_7],
    Branch01=["Bygningsdele u. usikkerhedsfaktor", num_39],
    Branch02=["Bygningsdele m. usikkerhedsfaktor", num_40],
    Branch03=["Samlet bygning u. usikkerhedsfaktor", num_41],
    Branch04=["Samlet bygning m. usikkerhedsfaktor", num_38],
    FlattenInputs=True)
entwine_13 = Entwine(
    Branch00=["Bygningsdele: Yder- & Indervægge", bygningsdele_2],
    Branch01=["Bygningsdele: Tage", bygningsdele_7],
    Branch02=["Bygningsdele: Dæk", bygningsdele_3],
    Branch03=["Bygningsdele: Terrændæk", bygningsdele_4],
    Branch04=["Bygningsdele: Fundamenter", bygningsdele],
    Branch05=["Bygningsdele: Vinduer, Døre, Glasfacader", bygningsdele_5],
    FlattenInputs=True)
bygningsdele_i_modellen = Panel(entwine_13)
panel_2 = Panel(entwine_12)

# ---- group: Grafer / Grafer - Bygningsdele (continued)
entwine_14 = Entwine(
    Branch00=[type_1_19, multiplication_38],
    Branch01=[type_2_15, multiplication_39],
    Branch02=[type_3_16, multiplication_40],
    Branch03=[type_4_16, multiplication_41],
    Branch04=[type_5_10, multiplication_42],
    Branch05=[type_6_10, multiplication_43],
    Branch06=[type_7_11, multiplication_44],
    Branch07=[type_8_9, multiplication_45],
    FlattenInputs=True)
item_17 = ListItem(List=entwine_14, Index=0, Wrap=True)  # -> flatten(Item)
item_18 = ListItem(List=entwine_14, Index=Slider(1, range=0..1), Wrap=True)  # -> flatten(Item)
chart_6 = CreateChart(
    ChartName=overskrift_3,
    ChartSeries="Tage & lofter",
    ChartXAxisLabels=item_17,
    ValueTree=item_18,
    Chart_Theme="Bright Pastel",
    Chart_Type="Column")

# ---- group: Grafer / Grafer over samlede bygningsdele (continued)
entwine_15 = Entwine(
    Branch00=["Teknik, standard værdier", num_4],
    Branch01=["Yder- & Indervægge", num_9],
    Branch02=["Tage", num_37],
    Branch03=["Dæk", num_18],
    Branch04=["Terrændæk", num_27],
    Branch05=["Fundamenter", num_8],
    Branch06=["Vinduer, Døre, Glasfacader", num_28],
    FlattenInputs=True)
item_19 = ListItem(List=entwine_15, Index=0, Wrap=True)  # -> flatten(Item)
item_20 = ListItem(List=entwine_15, Index=Slider(1, range=0..1), Wrap=True)  # -> flatten(Item)
chart_7 = CreateChart(
    ChartName=overskrift,
    ChartSeries="Bygningsdele",
    ChartXAxisLabels=item_19,
    ValueTree=item_20,
    Chart_Theme="Bright Pastel",
    Chart_Type="Column")

# ---- group: Live visning af ændringer i EXCEL 'Resultat ark' / Resultat udskrivning
usikkerhedsfaktor_4 = Number(usikkerhedsfaktor)
udledning_bygningsdele = Number(pr_år)
gulvareal = Number(gulvareal_m2)
drift_3 = Number(addition_9)
excelwrite = ExcelWriteLEGACY(
    WriteToggle=toggle,
    WriteHeading=toggle,
    ClearSheet=False,
    Worksheet=Slider(1, range=0..10),
    ColumnStart=Slider(1, range=0..10),
    RowStart=Slider(24, range=0..100),
    ColumnHeadings="GWP m. usikkerhedsfaktor",
    Column1=drift_3)
excelwrite_2 = ExcelWriteLEGACY(
    WriteToggle=toggle,
    WriteHeading=toggle,
    ClearSheet=False,
    Worksheet=Slider(1, range=0..10),
    ColumnStart=Slider(1, range=0..10),
    RowStart=Slider(18, range=0..100),
    ColumnHeadings="Udledning bygningsdele",
    Column1=udledning_bygningsdele)
excelwrite_3 = ExcelWriteLEGACY(
    WriteToggle=toggle,
    WriteHeading=toggle,
    ClearSheet=False,
    Worksheet=Slider(1, range=0..10),
    ColumnStart=Slider(1, range=0..10),
    RowStart=Slider(10, range=0..10),
    ColumnHeadings="Usikkerhedsfaktor på bygningsdele",
    Column1=usikkerhedsfaktor_4)
excelwrite_4 = ExcelWriteLEGACY(
    WriteToggle=toggle,
    WriteHeading=toggle,
    ClearSheet=False,
    Worksheet=Slider(1, range=0..10),
    ColumnStart=Slider(1, range=0..10),
    RowStart=Slider(4, range=0..10),
    ColumnHeadings="Brutto Areal",
    Column1=gulvareal)
betragtningsperiode = Number(analyseperiode_år)
drift_4 = Number(drift_2)
drift_5 = Number(addition_8)
excelwrite_5 = ExcelWriteLEGACY(
    WriteToggle=toggle,
    WriteHeading=toggle,
    ClearSheet=False,
    Worksheet=Slider(1, range=0..10),
    ColumnStart=Slider(1, range=0..10),
    RowStart=Slider(21, range=0..100),
    ColumnHeadings="GWP u. usikkerhedsfaktor",
    Column1=drift_5)
excelwrite_6 = ExcelWriteLEGACY(
    WriteToggle=toggle,
    WriteHeading=toggle,
    ClearSheet=False,
    Worksheet=Slider(1, range=0..10),
    ColumnStart=Slider(1, range=0..10),
    RowStart=Slider(7, range=0..10),
    ColumnHeadings="Betragtningsperiode",
    Column1=betragtningsperiode)
excelwrite_7 = ExcelWriteLEGACY(
    WriteToggle=toggle,
    WriteHeading=toggle,
    ClearSheet=False,
    Worksheet=Slider(1, range=0..10),
    ColumnStart=Slider(1, range=0..10),
    RowStart=Slider(15, range=0..100),
    ColumnHeadings="Udledning drift",
    Column1=drift_4)

# ---- group: Live visning af ændringer i EXCEL 'Resultat ark' / Bygnignsdelsudskrivning
entwine_16 = Entwine(
    Branch00=[ydervægge_2, indervægge_2, multiplication_8, areal],
    Branch01=[ydervægge_3, indervægge_3, multiplication_9, areal_2],
    Branch02=[ydervægge_4, indervægge_4, multiplication_10, areal_3],
    Branch03=[ydervægge_5, indervægge_5, multiplication_11, areal_4],
    Branch04=[ydervægge_6, indervægge_6, multiplication_12, areal_5],
    Branch05=[ydervægge_7, indervægge_7, multiplication_13, areal_6],
    Branch06=[ydervæg, indervægge_8, multiplication_14, areal_7],
    Branch07=[ydervægge_8, indervægge_9, multiplication_15, areal_8],
    FlattenInputs=True)
entwine_17 = Entwine(
    Branch00=[type_1_19, multiplication_38, num_32],
    Branch01=[type_2_15, multiplication_39, num_33],
    Branch02=[type_3_16, multiplication_40, num_34],
    Branch03=[type_4_16, multiplication_41, num_29],
    Branch04=[type_5_10, multiplication_42, num_35],
    Branch05=[type_6_10, multiplication_43, num_36],
    Branch06=[type_7_11, multiplication_44, num_30],
    Branch07=[type_8_9, multiplication_45, num_31],
    FlattenInputs=True)
entwine_18 = Entwine(
    Branch00=[type_1_10, multiplication_16, num_10],
    Branch01=[type_2_6, multiplication_17, num_11],
    Branch02=[type_3_6, multiplication_18, num_12],
    Branch03=[type_4_6, multiplication_19, num_13],
    Branch04=[type_5_4, multiplication_20, num_14],
    Branch05=[type_6_4, multiplication_21, num_15],
    Branch06=[type_7_5, multiplication_22, num_16],
    Branch07=[type_8_3, multiplication_23, num_17],
    FlattenInputs=True)
entwine_19 = Entwine(
    Branch00=[type_1_13, multiplication_26, num_19],
    Branch01=[type_2_9, multiplication_24, num_20],
    Branch02=[type_3_9, multiplication_25, num_21],
    Branch03=[type_4_9, multiplication_27, num_22],
    Branch04=[type_5_7, multiplication_28, num_23],
    Branch05=[type_6_7, multiplication_29, num_24],
    Branch06=[type_7_8, multiplication_30, num_25],
    Branch07=[type_8_6, multiplication_31, num_26],
    FlattenInputs=True)
entwine_20 = Entwine(
    Branch00=[type_1, multiplication_4, antal, meter],
    Branch01=[type_2, multiplication_5, antal_2, meter_2],
    Branch02=[type_3, multiplication_6, antal_3, meter_3],
    Branch03=[type_4, multiplication_7, antal_4, meter_4],
    FlattenInputs=True)
entwine_21 = Entwine(
    Branch00=[type_1_16, multiplication_37, antal_5],
    Branch01=[type_2_12, multiplication_32, antal_6],
    Branch02=[type_3_12, multiplication_33, antal_7],
    Branch03=[type_4_13, multiplication_34, antal_8],
    Branch04=[type_4_14, multiplication_35, areal_9],
    Branch05=[type_4_11, areal_10, multiplication_36],
    FlattenInputs=True)
number_slider = Slider(1, range=0..10)
number_slider_2 = Slider(1, range=0..10)
number_slider_3 = Slider(1, range=0..10)
number_slider_4 = Slider(1, range=0..10)
number_slider_5 = Slider(1, range=0..10)
number_slider_6 = Slider(1, range=0..10)
data = Data(entwine_16)
data_2 = Data(entwine_16)
data_3 = Data(entwine_16)
data_4 = Data(entwine_18)
data_5 = Data(entwine_18)
data_6 = Data(entwine_18)
data_7 = Data(entwine_17)
data_8 = Data(entwine_17)
data_9 = Data(entwine_17)
data_10 = Data(entwine_19)
data_11 = Data(entwine_19)
data_12 = Data(entwine_19)
data_13 = Data(entwine_20)
data_14 = Data(entwine_20)
data_15 = Data(entwine_20)
data_16 = Data(entwine_21)
data_17 = Data(entwine_21)
data_18 = Data(entwine_21)
panel_3 = Panel("""Bygningsdel
Stk / meter
GWP Total""")
panel_4 = Panel("""Bygningsdel
Stk / Areal
GWP Total""")
item_21 = ListItem(List=data, Index=Slider(0, range=0..100), Wrap=True)  # -> flatten(Item)
item_22 = ListItem(List=data_2, Index=Slider(2, range=0..100), Wrap=True)  # -> flatten(Item)
item_23 = ListItem(List=data_3, Index=Slider(1, range=0..100), Wrap=True)  # -> flatten(Item)
item_24 = ListItem(List=data_7, Index=Slider(0, range=0..100), Wrap=True)  # -> flatten(Item)
item_25 = ListItem(List=data_8, Index=Slider(2, range=0..100), Wrap=True)  # -> flatten(Item)
item_26 = ListItem(List=data_9, Index=Slider(1, range=0..100), Wrap=True)  # -> flatten(Item)
item_27 = ListItem(List=data_4, Index=Slider(0, range=0..100), Wrap=True)  # -> flatten(Item)
item_28 = ListItem(List=data_5, Index=Slider(1, range=0..100), Wrap=True)  # -> flatten(Item)
item_29 = ListItem(List=data_6, Index=Slider(2, range=0..100), Wrap=True)  # -> flatten(Item)
item_30 = ListItem(List=data_10, Index=Slider(0, range=0..100), Wrap=True)  # -> flatten(Item)
item_31 = ListItem(List=data_11, Index=Slider(2, range=0..100), Wrap=True)  # -> flatten(Item)
item_32 = ListItem(List=data_12, Index=Slider(1, range=0..100), Wrap=True)  # -> flatten(Item)
item_33 = ListItem(List=data_13, Index=Slider(0, range=0..100), Wrap=True)  # -> flatten(Item)
item_34 = ListItem(List=data_14, Index=Slider(1, range=0..100), Wrap=True)  # -> flatten(Item)
item_35 = ListItem(List=data_15, Index=Slider(2, range=0..100), Wrap=True)  # -> flatten(Item)
item_36 = ListItem(List=data_16, Index=Slider(0, range=0..100), Wrap=True)  # -> flatten(Item)
item_37 = ListItem(List=data_17, Index=Slider(1, range=0..100), Wrap=True)  # -> flatten(Item)
item_38 = ListItem(List=data_18, Index=Slider(2, range=0..100), Wrap=True)  # -> flatten(Item)
excelwrite_8 = ExcelWriteLEGACY(
    WriteToggle=toggle,
    WriteHeading=toggle,
    ClearSheet=toggle,
    Worksheet=Slider(2, range=0..10),
    ColumnStart=number_slider,
    RowStart=number_slider,
    ColumnHeadings=panel,
    Column1=item_21,
    Column2=item_22,
    Column3=item_23)
excelwrite_9 = ExcelWriteLEGACY(
    WriteToggle=toggle,
    WriteHeading=toggle,
    ClearSheet=toggle,
    Worksheet=Slider(3, range=0..10),
    ColumnStart=number_slider_2,
    RowStart=number_slider_2,
    ColumnHeadings=panel,
    Column1=item_24,
    Column2=item_25,
    Column3=item_26)
excelwrite_10 = ExcelWriteLEGACY(
    WriteToggle=toggle,
    WriteHeading=toggle,
    ClearSheet=toggle,
    Worksheet=Slider(4, range=0..10),
    ColumnStart=number_slider_3,
    RowStart=number_slider_3,
    ColumnHeadings=panel,
    Column1=item_27,
    Column2=item_28,
    Column3=item_29)
excelwrite_11 = ExcelWriteLEGACY(
    WriteToggle=toggle,
    WriteHeading=toggle,
    ClearSheet=toggle,
    Worksheet=Slider(5, range=0..10),
    ColumnStart=number_slider_4,
    RowStart=number_slider_4,
    ColumnHeadings=panel,
    Column1=item_30,
    Column2=item_31,
    Column3=item_32)
excelwrite_12 = ExcelWriteLEGACY(
    WriteToggle=toggle,
    WriteHeading=toggle,
    ClearSheet=toggle,
    Worksheet=Slider(6, range=0..10),
    ColumnStart=number_slider_5,
    RowStart=number_slider_5,
    ColumnHeadings=panel_3,
    Column1=item_33,
    Column2=item_34,
    Column3=item_35)
excelwrite_13 = ExcelWriteLEGACY(
    WriteToggle=toggle,
    WriteHeading=toggle,
    ClearSheet=toggle,
    Worksheet=Slider(7, range=0..10),
    ColumnStart=number_slider_6,
    RowStart=number_slider_6,
    ColumnHeadings=panel_4,
    Column1=item_36,
    Column2=item_37,
    Column3=item_38)

# ==== cluster GWP
L = ClusterInput()
S = ClusterInput()
M = ClusterInput()
mindex = MemberIndex(Set=S, Member=M)  # -> Index, Count
null = NullItem(Item=mindex.Index)  # -> flatten(NullFlags), InvalidFlags, Description
not = GateNot(A=null.NullFlags)
cull = CullPattern(List=L, CullPattern=not)
L_2 = ClusterOutput(cull)

# ==== cluster Ydervægge
path = ClusterInput()
read = ClusterInput()
path_2 = FilePath(path)
txt = Text("Ydervægge")
excelread = ExcelReader(ReadExcelData=read, WorkbookPath=path_2, WorksheetName=txt)  # -> Exceptions, ExcelData
branch = TreeBranch(Tree=excelread.ExcelData, Path=Slider(1, range=0..1), MaintainPaths=True)
branch_2 = TreeBranch(Tree=excelread.ExcelData, Path=Slider(0, range=0..1), MaintainPaths=True)
bygningsdel = ClusterOutput(branch_2)
gwp = ClusterOutput(branch)

# ==== cluster Cluster
E = ClusterInput()
E_2 = ClusterInput()
e_name = ElementName(Element=E)  # -> Element, Name
e_name_2 = ElementName(Element=E_2)  # -> Element, Name
cset = CreateSet(List=e_name.Name)  # -> Set, Map
mindex = MemberIndex(Set=cset.Set, Member=e_name_2.Name)  # -> Index, Count
cull_i = CullIndex(List=cset.Set, Indices=flatten(mindex.Index), Wrap=True)
L = ClusterOutput(cull_i)

# ==== cluster Type1
T = ClusterInput()
L = ClusterInput()
typefltr = TypeFilter(Types=T, Inverted=False)
elements = QueryElements(Filter=typefltr, Limit=L)  # -> Elements, Count
geometry = ElementGeometry(Elements=elements.Elements)
inspect = InspectElement(Element=elements.Elements)
G = ClusterOutput(geometry)
ma = MassAddition(Input=inspect)  # -> Result, PartialResults
division = Division(A=ma.Result, B="1000000")
R = ClusterOutput(division)

# ==== cluster Tage
path = ClusterInput()
read = ClusterInput()
path_2 = FilePath(path)
txt = Text("Tage")
excelread = ExcelReader(ReadExcelData=read, WorkbookPath=path_2, WorksheetName=txt)  # -> Exceptions, ExcelData
branch = TreeBranch(Tree=excelread.ExcelData, Path=Slider(1, range=0..1), MaintainPaths=True)
branch_2 = TreeBranch(Tree=excelread.ExcelData, Path=Slider(0, range=0..1), MaintainPaths=True)
gwp = ClusterOutput(branch)
bygningsdel = ClusterOutput(branch_2)

# ==== cluster Dæk
path = ClusterInput()
read = ClusterInput()
path_2 = FilePath(path)
txt = Text("Dæk")
excelread = ExcelReader(ReadExcelData=read, WorkbookPath=path_2, WorksheetName=txt)  # -> Exceptions, ExcelData
branch = TreeBranch(Tree=excelread.ExcelData, Path=Slider(1, range=0..1), MaintainPaths=True)
branch_2 = TreeBranch(Tree=excelread.ExcelData, Path=Slider(0, range=0..1), MaintainPaths=True)
gwp = ClusterOutput(branch)
bygningsdel = ClusterOutput(branch_2)

# ==== cluster Terrændæk
path = ClusterInput()
read = ClusterInput()
path_2 = FilePath(path)
txt = Text("Terrændæk")
excelread = ExcelReader(ReadExcelData=read, WorkbookPath=path_2, WorksheetName=txt)  # -> Exceptions, ExcelData
branch = TreeBranch(Tree=excelread.ExcelData, Path=Slider(1, range=0..1), MaintainPaths=True)
branch_2 = TreeBranch(Tree=excelread.ExcelData, Path=Slider(0, range=0..1), MaintainPaths=True)
gwp = ClusterOutput(branch)
bygningsdel = ClusterOutput(branch_2)

# ==== cluster Fundamenter
path = ClusterInput()
read = ClusterInput()
path_2 = FilePath(path)
txt = Text("Fundamenter")
excelread = ExcelReader(ReadExcelData=read, WorkbookPath=path_2, WorksheetName=txt)  # -> Exceptions, ExcelData
branch = TreeBranch(Tree=excelread.ExcelData, Path=Slider(1, range=0..1), MaintainPaths=True)
branch_2 = TreeBranch(Tree=excelread.ExcelData, Path=Slider(0, range=0..1), MaintainPaths=True)
gwp = ClusterOutput(branch)
bygningsdel = ClusterOutput(branch_2)

# ==== cluster Type1_2
T = ClusterInput()
L = ClusterInput()
typefltr = TypeFilter(Types=T, Inverted=False)
elements = QueryElements(Filter=typefltr, Limit=L)  # -> Elements, Count
geometry = ElementGeometry(Elements=elements.Elements)
inspect = InspectElement(Element=elements.Elements)
G = ClusterOutput(geometry)
lng = ListLength(List=flatten(geometry))
num = Number("1000")
L_2 = ClusterOutput(lng)
division = Division(A=inspect, B=num)
ma = MassAddition(Input=division)  # -> Result, PartialResults
R = ClusterOutput(ma.Result)

# ==== cluster VinduerDøreGlasfacader
path = ClusterInput()
read = ClusterInput()
path_2 = FilePath(path)
txt = Text("Vinduer, Døre, Glasfacader")
excelread = ExcelReader(ReadExcelData=read, WorkbookPath=path_2, WorksheetName=txt)  # -> Exceptions, ExcelData
branch = TreeBranch(Tree=excelread.ExcelData, Path=Slider(1, range=0..1), MaintainPaths=True)
branch_2 = TreeBranch(Tree=excelread.ExcelData, Path=Slider(0, range=0..1), MaintainPaths=True)
gwp = ClusterOutput(branch)
bygningsdel = ClusterOutput(branch_2)

# ==== cluster Indervægge
path = ClusterInput()
read = ClusterInput()
path_2 = FilePath(path)
txt = Text("Indervægge")
excelread = ExcelReader(ReadExcelData=read, WorkbookPath=path_2, WorksheetName=txt)  # -> Exceptions, ExcelData
branch = TreeBranch(Tree=excelread.ExcelData, Path=Slider(1, range=0..1), MaintainPaths=True)
branch_2 = TreeBranch(Tree=excelread.ExcelData, Path=Slider(0, range=0..1), MaintainPaths=True)
gwp = ClusterOutput(branch)
bygningsdel = ClusterOutput(branch_2)

# ==== cluster Type8
gwp = ClusterInput()
antal = ClusterInput()
expression = Expression(Antal=antal, Expression="Format(\"Areal: {0} m².\", Round(Antal,2))")
expression_2 = Expression(GWP=gwp, Expression="Format(\"GWP: {0} CO2-eq.\", Round(GWP,2))")
antal_2 = ClusterOutput(expression)
gwp_2 = ClusterOutput(expression_2)

# ==== cluster Type1_3
gwp = ClusterInput()
meter = ClusterInput()
antal = ClusterInput()
expression = Expression(Antal=antal, Expression="Format(\"Antal: {0} stk.\", Round(Antal,0))")
expression_2 = Expression(GWP=gwp, Expression="Format(\"GWP: {0} CO2-eq.\", Round(GWP,2))")
expression_3 = Expression(Meter=meter, Expression="Format(\"Meter: {0} m\", Round(Meter,0))")
gwp_2 = ClusterOutput(expression_2)
clean = CleanTree(RemoveNulls=True, RemoveInvalid=True, RemoveEmpty=False, Tree=[expression_3, expression])
mængde = ClusterOutput(clean)

# ==== cluster Type1_4
T = ClusterInput()
L = ClusterInput()
typefltr = TypeFilter(Types=T, Inverted=False)
elements = QueryElements(Filter=typefltr, Limit=L)  # -> Elements, Count
lng = ListLength(List=flatten(elements.Elements))
geometry = ElementGeometry(Elements=elements.Elements)
L_2 = ClusterOutput(lng)
G = ClusterOutput(geometry)

# ==== cluster Glasfacader
gwp = ClusterInput()
antal = ClusterInput()
expression = Expression(GWP=gwp, Expression="Format(\"GWP: {0} CO2-eq.\", Round(GWP,2))")
expression_2 = Expression(Antal=antal, Expression="Format(\"Areal: {0} m².\", Round(Antal,2))")
gwp_2 = ClusterOutput(expression)
areal = ClusterOutput(expression_2)

# ==== cluster Vinduer
gwp = ClusterInput()
antal = ClusterInput()
expression = Expression(GWP=gwp, Expression="Format(\"GWP: {0} CO2-eq.\", Round(GWP,2))")
expression_2 = Expression(Antal=antal, Expression="Format(\"Areal: {0} m².\", Round(Antal,2))")
gwp_2 = ClusterOutput(expression)
antal_2 = ClusterOutput(expression_2)

# ==== cluster Vinduer_2
T = ClusterInput()
L = ClusterInput()
typefltr = TypeFilter(Types=T, Inverted=False)
elements = QueryElements(Filter=typefltr, Limit=L)  # -> Elements, Count
geometry = ElementGeometry(Elements=elements.Elements)  # -> Elements, Geometry, Categories
sunion = SolidUnion(Breps=geometry.Geometry)
G = ClusterOutput(geometry.Geometry)
bvol = BoundaryVolume(Boundaries=sunion)
boxprop = BoxProperties(Box=bvol)  # -> Center, Diagonal, Area, Volume, Degeneracy
devec = DeconstructVector(Vector=boxprop.Diagonal)  # -> XComponent, YComponent, ZComponent
sort = SortList(Keys=[devec.XComponent, devec.YComponent, devec.ZComponent])  # -> reverse(Keys), ValuesA
item = ListItem(List=sort.Keys, Index=Slider(0, range=0..1), Wrap=True)
item_2 = ListItem(List=sort.Keys, Index=Slider(1, range=0..1), Wrap=True)
multiplication = Multiplication(A=item, B=item_2)
division = Division(A=multiplication, B="1000000")
ma = MassAddition(Input=flatten(division))  # -> Result, PartialResults
R = ClusterOutput(ma.Result)

# ==== cluster Type1_5
gwp = ClusterInput()
antal = ClusterInput()
expression = Expression(GWP=gwp, Expression="Format(\"GWP: {0} CO2-eq.\", Round(GWP,2))")
expression_2 = Expression(Antal=antal, Expression="Format(\"Antal: {0} stk.\", Round(Antal,2))")
gwp_2 = ClusterOutput(expression)
antal_2 = ClusterOutput(expression_2)

# ==== cluster Cluster_2
panel = Panel("""2.63
2.45
2.80
2.67
3.13
2.46
2.16""")
panel_2 = Panel("""3
1
2
2
2
2
4""")
i = ClusterInput()
i_2 = ClusterInput()
drift = ListItem(List=panel, Index=i, Wrap=True)
teknik = ListItem(List=panel_2, Index=i_2, Wrap=True)
i_3 = ClusterOutput(drift)
i_4 = ClusterOutput(teknik)

# ==== cluster Exclude
E = ClusterInput()
C = ClusterInput()
exclude = ExclusionFilter(Elements=E, Inverted=False)
types = QueryTypes(Kind=3, Category=C, Filter=exclude)
T = ClusterOutput(types)

# ==== cluster Cluster_3
T = ClusterInput()
L = ClusterInput()
typefltr = TypeFilter(Types=T, Inverted=False)
elements = QueryElements(Filter=typefltr, Limit=L)  # -> Elements, Count
E = ClusterOutput(elements.Elements)
inspect = InspectElement(Element=elements.Elements)
ma = MassAddition(Input=inspect)  # -> Result, PartialResults
division = Division(A=ma.Result, B="1000000")
R = ClusterOutput(division)
